# Dynamo graph revit-snaptrude-1.5.dyn "revit-snaptrude" (Dynamo 2.10.1.3976)
# packages: SpeckleDynamo2 2.0.0

wall_types = Python()  # IronPython2
# ---------- wall_types.python (318 lines) ----------
import sys
sys.path.append("C:\Program Files (x86)\IronPython 2.7\Lib")
import clr
import json
import os
import re

clr.AddReference("RevitServices")
import RevitServices
from RevitServices.Persistence import DocumentManager
doc =  DocumentManager.Instance.CurrentDBDocument

clr.AddReference("RevitAPIIFC")
clr.AddReference("RevitAPI")
from Autodesk.Revit.DB import *
from Autodesk.Revit.DB.Visual import *
from Autodesk.Revit.DB.IFC import *

###### Inputs ######
def IsElementsVisibleInCurrentView(category):
	view = doc.ActiveView
	categoryFilter = ElementCategoryFilter(category)
	collector = FilteredElementCollector( doc, view.Id).WhereElementIsNotElementType().WherePasses(categoryFilter)
	return collector.ToElements()
	
def getVisibleElements(category):
	obj = IsElementsVisibleInCurrentView(category)
	return obj

CATEGORY = BuiltInCategory.OST_Walls
walls = getVisibleElements(CATEGORY)

###### Definitions ######
def isclose(a, b, rel_tol=1e-09, abs_tol=0.0):
    return abs(a-b) <= max(rel_tol * max(abs(a), abs(b)), abs_tol)
    
def convertUnitsTomm(value, unit):
	if UnitTypeId.Inches == unit:
		return value*25.4
	elif UnitTypeId.Centimeters == unit:
		return value*10
	elif UnitTypeId.Feet == unit:
		return value*304.8
	elif UnitTypeId.Millimeters == unit:
		return value
	print unit
	return value

def GetMaterialInfo(mat):
	value = {}
	def GetTextureInformation(texture_path, asset):
		"""
		Get texture information from unifiedBitMap
		"""
		#print asset
		value["path"] = os.path.basename(texture_path)
		if asset.FindByName("texture_RealWorldScaleX") and asset.FindByName("texture_RealWorldScaleY"):
			unitX = asset.FindByName("texture_RealWorldScaleX").GetUnitTypeId()
			unitY = asset.FindByName("texture_RealWorldScaleY").GetUnitTypeId()
			uScale = asset.FindByName("texture_RealWorldScaleX").Value
			vScale = asset.FindByName("texture_RealWorldScaleY").Value
				#print uScale, uScale, unitX.TypeId
			value["uScale"] = convertUnitsTomm(uScale, unitX)
			value["vScale"] = convertUnitsTomm(vScale, unitY)
		else:
			if asset.FindByName("texture_UScale"):
				value["uScale"] = asset.FindByName("texture_UScale").Value
			if asset.FindByName("texture_VScale"):
				value["vScale"] = asset.FindByName("texture_VScale").Value
		if asset.FindByName("texture_UOffset"):
			value["uOffset"] = asset.FindByName("texture_UOffset").Value
		if  asset.FindByName("texture_VOffset"):
			value["vOffset"] = asset.FindByName("texture_VOffset").Value
		if asset.FindByName("texture_WAngle"):
			value["wAng"] = asset.FindByName("texture_WAngle").Value
		
	def getparameterFromAsset(asset):
		"""
		Used for nested Asset
		"""
		
		for i in range(asset.Size):
			#print getRenderingAsset.Get(i).Name
			name = asset.Get(i).Name
			if name == "unifiedbitmap_Bitmap":
				texture_path = asset.FindByName("unifiedbitmap_Bitmap").Value
				if texture_path:
					GetTextureInformation(texture_path, asset)
					return value
	
	appearanceAssetId = mat.AppearanceAssetId
	
	assetElem = doc.GetElement(appearanceAssetId)
	if not assetElem: # return consistent color
		value['diffuseColor'] = [float(mat.Color.Red)/255, float(mat.Color.Green)/255, float(mat.Color.Blue)/255, 1 - float(mat.Transparency)/100]
		value['name'] = mat.Id.ToString()
		return value
	#print assetElem.Name
	
	getRenderingAsset = assetElem.GetRenderingAsset()
	value["name"] = assetElem.Name
	
	property = getRenderingAsset.FindByName("localname")
	if property:
		property = property.Value.ToString()
		value["type"] = property
		# if material class is Glass
		if property == "Glazing":
			GLAZINGCOLOR = ["Clear", "Green", "Gray","Blue", "Bluegreen", "Bronze", "Custom"]
			colorMap = getRenderingAsset.FindByName("glazing_transmittance_color").Value
			glassColor = GLAZINGCOLOR[colorMap]
				
			if glassColor == "Clear":
				value["diffuseColor"] = [0,0,0,0.2]
			elif glassColor == "Green":
				value["diffuseColor"] = [0,1,0,0.2]
			elif glassColor == "Gray":
				value["diffuseColor"] = [0.32, 0.32, 0.32,0.2]
			elif glassColor == "Blue":
				value["diffuseColor"] = [0, 0, 1,0.2]
			elif glassColor == "Bluegreen":
				value["diffuseColor"] = [0.05,0.59,0.73,0.2]
			elif glassColor == "Bronze":
				value["diffuseColor"] = [0.8, 0.5,0.2,0.2]
			else:
				colorMap = getRenderingAsset.FindByName("glazing_transmittance_map").GetValueAsDoubles()
				value["diffuseColor"] = [ i for i in colorMap]
				value["diffuseColor"].append(0.2)
			#print value["diffuseColor"]
			return value
	
	for i in range(getRenderingAsset.Size):
			name = getRenderingAsset.Get(i).Name
			if name == "unifiedbitmap_Bitmap":
				texture_path = asset.FindByName("unifiedbitmap_Bitmap").Value
				if texture_path:
					GetTextureInformation(texture_path, getRenderingAsset)
					#print value		
			property = getRenderingAsset.FindByName(name)
			# diffuse => generic, glazing => glazing class
			isValidProperty = re.search("(?=(diffuse))",property.Name.ToString() ) or re.search(r'(?=(color))',property.Name.ToString()) or re.search(r"(?=(glazing))", property.Name.ToString())
			
				
			if property.NumberOfConnectedProperties > 0 and property.Name.ToString() not in ["common_Tint_color"] and isValidProperty:
			 	
			 	if isinstance(property, AssetPropertyDoubleArray4d):
			 		value["diffuseColor"] = [ i for i in property.GetValueAsDoubles()]
			 		alpha = getRenderingAsset.FindByName("generic_transparency")
			 		if alpha and alpha.Value != 0:
			 			value["diffuseColor"][3] = float(1 - alpha.Value)
				getparameterFromAsset(property.GetAllConnectedProperties()[0])
				
				
			elif isinstance(property, AssetPropertyDoubleArray4d) and property.Name.ToString() not in ["common_Tint_color"] and isValidProperty :
				#print property.Name.ToString(), property.GetValueAsDoubles()
				value["diffuseColor"] = [ i for i in property.GetValueAsDoubles()]
				alpha = getRenderingAsset.FindByName("generic_transparency")
			 	if alpha and alpha.Value != 0:
			 		value["diffuseColor"][3] = float(1 - alpha.Value)
								
	return value
		

def GetLayerMaterials(wt):	
	
	compStr = wt.GetCompoundStructure()
	layerMaterial = [] 
	if compStr:
		#Get layers if compound struture is present.
		layers = compStr.GetLayers()	
		for i in range(len(layers)):
			mat = doc.GetElement(layers[i].MaterialId)
			#print '*'*6, mat,'*'*6
			if mat:
				try:
					value = GetMaterialInfo(mat)
				except:
					value = None
				material = {"name":mat.Name, "value":value}
			else:
				type, value = None, None
				material = {"name":None, "value":value}
			#print  value
			
			width = compStr.GetLayerWidth(i) * 304.8 # feet to mm
			# Get layer width and it's function
			function = compStr.GetLayerFunction(i)
			if function == MaterialFunctionAssignment.Structure:
				function = "Structure"
			elif function == MaterialFunctionAssignment.Substrate:
				function = "Substrate"
			elif function == MaterialFunctionAssignment.Insulation:
				function = "Insulation"
			elif function ==  MaterialFunctionAssignment.Finish2:
				function = "Finish2"
			elif function ==  MaterialFunctionAssignment.Finish1:
				function = "Finish1"
			elif function ==  MaterialFunctionAssignment.Membrane:
				function = "Membrane"
			else:
				function = "Finish1"
			
			layerMaterial.append({ "material": material, "width": width,  "function":function }) 

					
		return layerMaterial
		
"""
tolist(Object obj1) : Returns Object [ ]
Ensure object is a list. If a single non-iterable object given, then it will be wrapped in a list.
"""
def tolist(obj1):
	if hasattr(obj1,"__iter__"): return obj1
	else: return [obj1]

###### Main Script ######
outList = []
# Loop through all the given Walls...
walltypes = set()
for w in walls:
	# Check if the Wall really is a Wall and not some other Element..
	if not w.GetType() == Wall:
		#outList.append(None)
		continue
	# Get the Walls WallType (aka FamilyType)	
	wt = w.WallType
	# If the Wall is a Basic Wall (so, not a stacked or curtain etc)...
	if wt.Kind == WallKind.Basic:
		# Get all the Materials in the Walls Compound Structure...
		name = Element.Name.GetValue(wt)

		if name not in walltypes:
			#print name 
			outList.append({ name : GetLayerMaterials(wt)})
			walltypes.add(name)
			#print "**"*8

		# We have what we need from this wall, skip to next wall...
		continue	
	# If the Wall is a Stacked Wall...
	if wt.Kind == WallKind.Stacked:		
		# Stacked walls are slightly different and require us to get the SubWalls in the stack...
		subWalls = [doc.GetElement(sw) for sw in w.GetStackedWallMemberIds()]
		# Check if there are subwalls...
		if not subWalls == None and len(subWalls) > 0:	
			# Get all the Materials for each subwall (if there is any)...	
			outList.append([GetLayerMaterials(wt.WallType) for wt in subWalls if not wt.WallType.GetCompoundStructure() == None])
		#else:
			#outList.append(None)		
    
wallSideProfile = {}
for w in walls:
	if w.GetType().ToString() in ["Autodesk.Revit.DB.FamilyInstance"]:
		continue
	try:
		if ExporterIFCUtils.HasElevationProfile(w):
			points = []
			curveLoops =  ExporterIFCUtils.GetElevationProfile(w)
			
			curveLoop = curveLoops[0]
			
			for cl in curveLoop.GetCurveLoopIterator():
				if isinstance(cl, Line):
					points.append([cl.GetEndPoint(0)[idx]* 304.8 for idx in range(3)])
				elif isinstance(cl, Arc) or isinstance(cl, Ellipse):
					arcPoints = cl.Tessellate()
					for i in range(len(arcPoints)-1):
						points.append([arcPoints[i][idx]* 304.8 for idx in range(3)])
			if len(points) == 4 and len(curveLoops) == 1:
				continue
			voids = []		
			if len(curveLoops) > 1 and len(curveLoops) == 2:
				void = []
				curveLoop = curveLoops[1]
				for cl in curveLoop.GetCurveLoopIterator():
					if isinstance(cl, Line):
						void.append([cl.GetEndPoint(0)[idx]* 304.8 for idx in range(3)])
					elif isinstance(cl, Arc) or isinstance(cl, Ellipse):
						arcPoints = cl.Tessellate()
						for i in range(len(arcPoints)-1):
							void.append([arcPoints[i][idx]* 304.8 for idx in range(3)])
				voids.append(void)
				
			
			wallSideProfile[w.Id.ToString()] = {"sideProfile": points, "voids":voids }
	except Exception as e:
		print e
		continue
			
			
wallsInserts = {}			
for w in walls:
	if w.GetType().ToString() in ["Autodesk.Revit.DB.FamilyInstance"]:
		continue
	try:
		wallInsert = []
		insertedWalls = w.FindInserts(False, False, True, False)
		curtainWallsElements = []
		if len(insertedWalls) > 0:
			for insertedWall in insertedWalls:
				element = doc.GetElement(insertedWall)
				curtainWallElements = []
				if element.Category.Name == "Walls":
					grid = element.CurtainGrid
					if grid:
						mullions = [grid.GetMullionIds()[i].ToString() for i in range(len(grid.GetMullionIds()))]
						panels = [grid.GetPanelIds()[i].ToString() for i in range(len(grid.GetPanelIds()))]
						curtainWallElements = mullions + panels
						curtainWallsElements.append(curtainWallElements)
						
			if len(curtainWallsElements) > 0:
				wallsInserts[w.Id.ToString()] = curtainWallsElements
						
	except Exception as e:
		print e
# Return the results to the Dynamo Workspace...
outList = json.dumps(outList), json.dumps(wallSideProfile), json.dumps(wallsInserts)
OUT = outList
# ----------------------------------------
floor_types = Python()  # IronPython2
# ---------- floor_types.python (247 lines) ----------
###### Imports ######

import sys
sys.path.append("C:\Program Files (x86)\IronPython 2.7\Lib")
import clr
import json
import os
import re

clr.AddReference("RevitServices")
import RevitServices
from RevitServices.Persistence import DocumentManager
doc =  DocumentManager.Instance.CurrentDBDocument

clr.AddReference("RevitAPI")
from Autodesk.Revit.DB import *
from Autodesk.Revit.DB.Visual import *

def IsElementsVisibleInCurrentView(category):
	view = doc.ActiveView
	categoryFilter = ElementCategoryFilter(category)
	collector = FilteredElementCollector( doc, view.Id).WhereElementIsNotElementType().WherePasses(categoryFilter)
	return collector.ToElements()
	
def getVisibleElements(category):
	obj = IsElementsVisibleInCurrentView(category)
	return obj
	
###### Inputs ######

CATEGORY = BuiltInCategory.OST_Floors
floors = getVisibleElements(CATEGORY)

###### Definitions ######
"""
convert units to mm
"""
def isclose(a, b, rel_tol=1e-09, abs_tol=0.0):
    return abs(a-b) <= max(rel_tol * max(abs(a), abs(b)), abs_tol)
    
def convertUnitsTomm(value, unit):
	if UnitTypeId.Inches == unit:
		return value*25.4
	elif UnitTypeId.Centimeters == unit:
		return value*10
	elif UnitTypeId.Feet == unit:
		return value*304.8
	elif UnitTypeId.Millimeters == unit:
		return value
	print unit
	return value



def GetMaterialInfo(mat):
	value = {}
	def GetTextureInformation(texture_path, asset):
		"""
		Get texture information from unifiedBitMap
		"""
		#print asset
		value["path"] = os.path.basename(texture_path)
		if asset.FindByName("texture_RealWorldScaleX") and asset.FindByName("texture_RealWorldScaleY"):
			unitX = asset.FindByName("texture_RealWorldScaleX").GetUnitTypeId()
			unitY = asset.FindByName("texture_RealWorldScaleY").GetUnitTypeId()
			uScale = asset.FindByName("texture_RealWorldScaleX").Value
			vScale = asset.FindByName("texture_RealWorldScaleY").Value
				#print uScale, uScale, unitX.TypeId
			value["uScale"] = convertUnitsTomm(uScale, unitX)
			value["vScale"] = convertUnitsTomm(vScale, unitY)
		else:
			if asset.FindByName("texture_UScale"):
				value["uScale"] = asset.FindByName("texture_UScale").Value
			if asset.FindByName("texture_VScale"):
				value["vScale"] = asset.FindByName("texture_VScale").Value
		if asset.FindByName("texture_UOffset"):
			value["uOffset"] = asset.FindByName("texture_UOffset").Value
		if  asset.FindByName("texture_VOffset"):
			value["vOffset"] = asset.FindByName("texture_VOffset").Value
		if asset.FindByName("texture_WAngle"):
			value["wAng"] = asset.FindByName("texture_WAngle").Value
		
	def getparameterFromAsset(asset):
		"""
		Used for nested Asset
		"""
		for i in range(asset.Size):
			#print getRenderingAsset.Get(i).Name
			name = asset.Get(i).Name
			if name == "unifiedbitmap_Bitmap":
				texture_path = asset.FindByName("unifiedbitmap_Bitmap").Value
				if texture_path:
					GetTextureInformation(texture_path, asset)
					return value
	
	appearanceAssetId = mat.AppearanceAssetId
	
	assetElem = doc.GetElement(appearanceAssetId)
	if not assetElem: # return consistent color
		value['diffuseColor'] = [float(mat.Color.Red)/255, float(mat.Color.Green)/255, float(mat.Color.Blue)/255, 1 - float(mat.Transparency)/100]
		value['name'] = mat.Id.ToString()
		return value
	#print assetElem.Name
	
	getRenderingAsset = assetElem.GetRenderingAsset()
	value["name"] = assetElem.Name
	property = getRenderingAsset.FindByName("localname")
	if property:
		property = property.Value.ToString()
		value["type"] = property
		# for glass material
		if property == "Glazing":
			GLAZINGCOLOR = ["Clear", "Green", "Gray","Blue", "Bluegreen", "Bronze", "Custom"]
			colorMap = getRenderingAsset.FindByName("glazing_transmittance_color").Value
			glassColor = GLAZINGCOLOR[colorMap]
				
			if glassColor == "Clear":
				value["diffuseColor"] = [0,0,0,0.2]
			elif glassColor == "Green":
				value["diffuseColor"] = [0,1,0,0.2]
			elif glassColor == "Gray":
				value["diffuseColor"] = [0.32, 0.32, 0.32,0.2]
			elif glassColor == "Blue":
				value["diffuseColor"] = [0, 0, 1,0.2]
			elif glassColor == "Bluegreen":
				value["diffuseColor"] = [0.05,0.59,0.73,0.2]
			elif glassColor == "Bronze":
				value["diffuseColor"] = [0.8, 0.5,0.2,0.2]
			else:
				colorMap = getRenderingAsset.FindByName("glazing_transmittance_map").GetValueAsDoubles()
				
				value["diffuseColor"] = [ i for i in colorMap]
				value["diffuseColor"].append(0.2)
			print value["diffuseColor"]
			return value
	
	for i in range(getRenderingAsset.Size):
			name = getRenderingAsset.Get(i).Name
			if name == "unifiedbitmap_Bitmap":
				texture_path = asset.FindByName("unifiedbitmap_Bitmap").Value
				if texture_path:
					GetTextureInformation(texture_path, getRenderingAsset)
					#print value		
			property = getRenderingAsset.FindByName(name)
			# diffuse => generic, glazing => glazing class
			isValidProperty = re.search("(?=(diffuse))",property.Name.ToString() ) or re.search(r'(?=(color))',property.Name.ToString()) or re.search(r"(?=(glazing))", property.Name.ToString())
			
			# if property has connected asset check if texture is present(unifiedbitmap_Bitmap)	
			if property.NumberOfConnectedProperties > 0 and property.Name.ToString() not in ["common_Tint_color"] and isValidProperty:
			 	
			 	if isinstance(property, AssetPropertyDoubleArray4d):
			 		value["diffuseColor"] = [ i for i in property.GetValueAsDoubles()]
			 		alpha = getRenderingAsset.FindByName("generic_transparency")
			 		if alpha and alpha.Value != 0:
			 			value["diffuseColor"][3] = float(1 - alpha.Value)
			 		
			 		
				getparameterFromAsset(property.GetAllConnectedProperties()[0])
				
			# if property is array, get diffuse color 
			elif isinstance(property, AssetPropertyDoubleArray4d) and property.Name.ToString() not in ["common_Tint_color"] and isValidProperty :
				#print property.Name.ToString(), property.GetValueAsDoubles()
				
				value["diffuseColor"] = [ i for i in property.GetValueAsDoubles()]
				alpha = getRenderingAsset.FindByName("generic_transparency")
			 	if alpha and alpha.Value != 0:
			 		value["diffuseColor"][3] = float(1 - alpha.Value)
				
				
	return value
		
		
def GetLayerMaterials(f):		
	compStr = f.GetCompoundStructure()
	layerMaterial = [] 
	#print "-"*8
	if compStr:
		layers = compStr.GetLayers()	
		for i in range(len(layers)):
			material = {"name" : None, "value":None}
			mat = doc.GetElement(layers[i].MaterialId)
			if mat:
				try:
					value = GetMaterialInfo(mat)
					#print value
				except:
					value = None
				material = {"name":mat.Name,  "value":value}
			width = compStr.GetLayerWidth(i) * 304.8 # feet to mm
			
			function = compStr.GetLayerFunction(i)
			if function == MaterialFunctionAssignment.Structure:
				function = "Structure"
			elif function == MaterialFunctionAssignment.Insulation:
				function = "Insulation"
			elif function ==  MaterialFunctionAssignment.Finish2:
				function = "Finish2"
			elif function ==  MaterialFunctionAssignment.Finish1:
				function = "Finish1"
			elif function ==  MaterialFunctionAssignment.Membrane:
				function = "Membrane"
			else:
				function = "finish"
			
			layerMaterial.append({ "material": material, "width": width,  "function":function }) 
				
				#print material
				#print function
				
				

					
		return layerMaterial



outList = []

###### Main Script ######

# Loop through all floors...
floorTypes = set()

for floor in floors:
	# Check if element is floor

	if not floor.GetType() == Floor:
		outList.append(None)
		continue
	# Get the Floor FloorType ( i.e.FamilyType)	
	f = floor.FloorType
	#print f
	# Get all the Materials in the Floor Compound Structure...
	name = Element.Name.GetValue(f)
	

	if name not in floorTypes:
		#print "------------------", name, "------------"
		outList.append({ name : GetLayerMaterials(f)})
		floorTypes.add(name)
		#print "*"*8
		continue			

# Return the results to the Dynamo Workspace...

outList = json.dumps(outList)
OUT = outList
# ----------------------------------------
ceiling_types = Python()  # IronPython2
# ---------- ceiling_types.python (376 lines) ----------
###### Imports ######
import sys
sys.path.append("C:\Program Files (x86)\IronPython 2.7\Lib")
import clr
import json
import os
import re

clr.AddReference("RevitServices")
import RevitServices
from RevitServices.Persistence import DocumentManager
doc =  DocumentManager.Instance.CurrentDBDocument

clr.AddReference("RevitAPIIFC")
clr.AddReference("RevitAPI")
from Autodesk.Revit.DB import *
from Autodesk.Revit.DB.Visual import *
from Autodesk.Revit.DB.IFC import *


###### Inputs ######
def IsElementsVisibleInCurrentView(category):
	view = doc.ActiveView
	categoryFilter = ElementCategoryFilter(category)
	collector = FilteredElementCollector( doc, view.Id).WhereElementIsNotElementType().WherePasses(categoryFilter)
	return collector.ToElements()
	
def getVisibleElements(category):
	obj = IsElementsVisibleInCurrentView(category)
	return obj



CATEGORY = BuiltInCategory.OST_Ceilings
ceilings = getVisibleElements(CATEGORY)

###### Definitions ######
"""
GetLayerFinish(material mat) : return typeMat , value
Return type of material and value correspoding to it.
type : [ "wood", "ceramic", "texture", "color", "concrete", "wall paint", "metal"]
"""
def convertUnitsTomm(value, unit):
	if UnitTypeId.Inches == unit:
		return value*25.4
	elif UnitTypeId.Centimeters == unit:
		return value*10
	elif UnitTypeId.Feet == unit:
		return value*304.8
	elif UnitTypeId.Millimeters == unit:
		return value
	print unit
	return value




def GetMaterialInfo(mat):
	value = {}
	def GetTextureInformation(texture_path, asset):
		"""
		Get texture information from unifiedBitMap
		"""
		#print asset
		value["path"] = os.path.basename(texture_path)
		if asset.FindByName("texture_RealWorldScaleX") and asset.FindByName("texture_RealWorldScaleY"):
			unitX = asset.FindByName("texture_RealWorldScaleX").GetUnitTypeId()
			unitY = asset.FindByName("texture_RealWorldScaleY").GetUnitTypeId()
			uScale = asset.FindByName("texture_RealWorldScaleX").Value
			vScale = asset.FindByName("texture_RealWorldScaleY").Value
				#print uScale, uScale, unitX.TypeId
			value["uScale"] = convertUnitsTomm(uScale, unitX)
			value["vScale"] = convertUnitsTomm(vScale, unitY)
		else:
			if asset.FindByName("texture_UScale"):
				value["uScale"] = asset.FindByName("texture_UScale").Value
			if asset.FindByName("texture_VScale"):
				value["vScale"] = asset.FindByName("texture_VScale").Value
		if asset.FindByName("texture_UOffset"):
			value["uOffset"] = asset.FindByName("texture_UOffset").Value
		if  asset.FindByName("texture_VOffset"):
			value["vOffset"] = asset.FindByName("texture_VOffset").Value
		if asset.FindByName("texture_WAngle"):
			value["wAng"] = asset.FindByName("texture_WAngle").Value
		
	def getparameterFromAsset(asset):
		"""
		Used for nested Asset
		"""
		
		for i in range(asset.Size):
			#print getRenderingAsset.Get(i).Name
			name = asset.Get(i).Name
			if name == "unifiedbitmap_Bitmap":
				texture_path = asset.FindByName("unifiedbitmap_Bitmap").Value
				if texture_path:
					GetTextureInformation(texture_path, asset)
					return value
	
	appearanceAssetId = mat.AppearanceAssetId
	
	assetElem = doc.GetElement(appearanceAssetId)
	if not assetElem: # return consistent color
		value['diffuseColor'] = [float(mat.Color.Red)/255, float(mat.Color.Green)/255, float(mat.Color.Blue)/255, 1 - float(mat.Transparency)/100]
		value['name'] = mat.Id.ToString()
		return value
	#print assetElem.Name
	
	getRenderingAsset = assetElem.GetRenderingAsset()
	value["name"] = assetElem.Name
	
	property = getRenderingAsset.FindByName("localname")
	if property:
		property = property.Value.ToString()
		value["type"] = property
		# if material class is Glass
		if property == "Glazing":
			GLAZINGCOLOR = ["Clear", "Green", "Gray","Blue", "Bluegreen", "Bronze", "Custom"]
			colorMap = getRenderingAsset.FindByName("glazing_transmittance_color").Value
			glassColor = GLAZINGCOLOR[colorMap]
				
			if glassColor == "Clear":
				value["diffuseColor"] = [0,0,0,0.2]
			elif glassColor == "Green":
				value["diffuseColor"] = [0,1,0,0.2]
			elif glassColor == "Gray":
				value["diffuseColor"] = [0.32, 0.32, 0.32,0.2]
			elif glassColor == "Blue":
				value["diffuseColor"] = [0, 0, 1,0.2]
			elif glassColor == "Bluegreen":
				value["diffuseColor"] = [0.05,0.59,0.73,0.2]
			elif glassColor == "Bronze":
				value["diffuseColor"] = [0.8, 0.5,0.2,0.2]
			else:
				colorMap = getRenderingAsset.FindByName("glazing_transmittance_map").GetValueAsDoubles()
				value["diffuseColor"] = [ i for i in colorMap]
				value["diffuseColor"].append(0.2)
			#print value["diffuseColor"]
			return value
	
	for i in range(getRenderingAsset.Size):
			name = getRenderingAsset.Get(i).Name
			if name == "unifiedbitmap_Bitmap":
				texture_path = asset.FindByName("unifiedbitmap_Bitmap").Value
				if texture_path:
					GetTextureInformation(texture_path, getRenderingAsset)
					#print value		
			property = getRenderingAsset.FindByName(name)
			# diffuse => generic, glazing => glazing class
			isValidProperty = re.search("(?=(diffuse))",property.Name.ToString() ) or re.search(r'(?=(color))',property.Name.ToString()) or re.search(r"(?=(glazing))", property.Name.ToString())
			
				
			if property.NumberOfConnectedProperties > 0 and property.Name.ToString() not in ["common_Tint_color"] and isValidProperty:
			 	
			 	if isinstance(property, AssetPropertyDoubleArray4d):
			 		value["diffuseColor"] = [ i for i in property.GetValueAsDoubles()]
			 		alpha = getRenderingAsset.FindByName("generic_transparency")
			 		if alpha and alpha.Value != 0:
			 			value["diffuseColor"][3] = float(1 - alpha.Value)
				getparameterFromAsset(property.GetAllConnectedProperties()[0])
				
				
			elif isinstance(property, AssetPropertyDoubleArray4d) and property.Name.ToString() not in ["common_Tint_color"] and isValidProperty :
				#print property.Name.ToString(), property.GetValueAsDoubles()
				value["diffuseColor"] = [ i for i in property.GetValueAsDoubles()]
				alpha = getRenderingAsset.FindByName("generic_transparency")
			 	if alpha and alpha.Value != 0:
			 		value["diffuseColor"][3] = float(1 - alpha.Value)
				
				
				
	return value
		
		
"""
GetLayerMaterials(CeilingType f) : Returns Material [ ]
Returns a list of Materials in the same order as the Compund Structure Layers of the given WallType.
Author: Dan Woodcock 
updated according to needs
"""
def GetLayerMaterials(f, ceiling):		
	compStr = f.GetCompoundStructure()
	layerMaterial = [] 
	#print "-"*8
	if compStr:
		layers = compStr.GetLayers()	
		for i in range(len(layers)):
			mat = doc.GetElement(layers[i].MaterialId)
			if mat:
				try:
					value = GetMaterialInfo(mat)
				except:
					value = None
				material = {"name":mat.Name, "value":value}
			else:
				material = {"name":None, "value":None}
				# Get width of layer
			width = compStr.GetLayerWidth(i) * 304.8 # feet to mm
			# Get function of layer
			function = compStr.GetLayerFunction(i)
			if function == MaterialFunctionAssignment.Structure:
				function = "Structure"
			elif function == MaterialFunctionAssignment.Insulation:
				function = "Insulation"
			elif function ==  MaterialFunctionAssignment.Finish2:
				function = "Finish2"
			elif function ==  MaterialFunctionAssignment.Finish1:
				function = "Finish1"
			elif function ==  MaterialFunctionAssignment.Membrane:
				function = "Membrane"
			else:
				function = "finish"
			
			layerMaterial.append({ "material": material, "width": width,  "function":function }) 
				
				#print material
				#print function	
		return layerMaterial
	else:
		matIds = ceiling.GetMaterialIds(False)
		mat = None
		if len(matIds) > 0:
			mat = doc.GetElement(matIds[0])
		if mat:
			try: 
				value = GetMaterialInfo(mat)
			except:
				value = None
			material = {"name":mat.Name, "value":value}
			layerMaterial.append({ "material": material, "width": 25,  "function": "Structure" })
			return layerMaterial
		
		
		
		

"""
tolist(Object obj1) : Returns Object [ ]
Ensure object is a list. If a single non-iterable object given, then it will be wrapped in a list.
"""
def tolist(obj1):
	if hasattr(obj1,"__iter__"): return obj1
	else: return [obj1]
	
###### Output ######

outList = []

###### Main Script ######

# Loop through all floors...
ceilingTypes = set()

for ceiling in ceilings:
	if not ceiling.GetType() == Ceiling:
		continue
	# Get the CeilingType ( i.e.FamilyType)	
	c = doc.GetElement(ceiling.GetTypeId())
	name = ceiling.Name.ToString()

	if name not in ceilingTypes:
		#print "------------------", name, "------------"
		outList.append({ name : GetLayerMaterials(c, ceiling)})
		ceilingTypes.add(name)
		#print "*"*8
		continue			


ceilingsData = {}
for c in ceilings:
	ceilingId = c.Id.ToString()
	type = c.Name.ToString()
	family = c.LookupParameter("Family").AsValueString()
	heightOffset = c.LookupParameter("Height Offset From Level")
	if heightOffset:
		heightOffset = heightOffset.AsValueString(FormatOptions(UnitTypeId.Millimeters))
	else:
		heightOffset = 0
	
	level = doc.GetElement(c.LevelId)
	if level:
		levelName = level.Name
	else:
		levelName = None
	ceilingsData[ceilingId] = {"family": family, "type": type, "level":levelName, "heightOffset": heightOffset}
	
	try:
		bottomProfileRef = HostObjectUtils.GetBottomFaces(c)
		#print bottomProfileRef
	except Exception as e: 
		print e
		continue
	
	try:
		bottomProfile = c.GetGeometryObjectFromReference(bottomProfileRef[0])
		if bottomProfile:
			FaceNormal =  bottomProfile.FaceNormal
			opt = Options()
			opt.View = doc.ActiveView
			geometry = c.get_Geometry(opt)
			sortedCurveLoops = []
			for geo in geometry:
				if isinstance(geo, Solid):
					for f in geo.Faces:
						try:
							currentFaceNormal = f.FaceNormal
						except Exception as e:
							currentFaceNormal = [0,0,0]
						areSameNormal = currentFaceNormal[2] ==  FaceNormal[2] and currentFaceNormal[1] ==  FaceNormal[1] and currentFaceNormal[0] ==  FaceNormal[0] 
							
						if areSameNormal:
							curveLoops = f.GetEdgesAsCurveLoops()
							sortedCurveLoops = ExporterIFCUtils.SortCurveLoops(curveLoops)
							curvesMap = {}
							voidsMap = {}
							for sortedcurveLoop in sortedCurveLoops:
								curveLoop = sortedcurveLoop[0]
								curveData = []
								curveIds = []
								curveKey = []
			
								for cl in curveLoop.GetCurveLoopIterator():
									if isinstance(cl, Arc):
										points = cl.Tessellate()
										for point in points:
											curveData.append([point[idx]* 304.8 for idx in range(3)])
										curveKey.append("["+", ".join([str(int(cl.GetEndPoint(0)[idx])) for idx in range(2)])+"]")
									elif isinstance(cl, Line):
										curveData.append([cl.GetEndPoint(0)[idx]* 304.8 for idx in range(3)])
										curveKey.append("["+", ".join([str(int(cl.GetEndPoint(0)[idx])) for idx in range(2)])+"]")
										
								curveKey.sort()	
								curveKey = '['+", ".join(curveKey)+']' + ceilingId
									
								curvesMap[curveKey] = curveData	
								if len(sortedcurveLoop) > 1:	
									voidsMap[curveKey] = {}
								for voidLoopId in range(1,len(sortedcurveLoop)):
									voidLoop = sortedcurveLoop[voidLoopId]
									voidsData = []
									voidKey = []
									for cl in voidLoop.GetCurveLoopIterator():
										try:
											if isinstance(cl, Arc): 
												points = cl.Tessellate()
												for point in points:
													voidsData.append([point[idx]* 304.8 for idx in range(3)])
												voidKey.append("["+", ".join([str(int(cl.GetEndPoint(0)[idx])) for idx in range(2)])+"]")
												continue
										except Exception as e:
											print e
											continue
												
										voidsData.append([cl.GetEndPoint(0)[idx]* 304.8 for idx in range(3)])
										voidKey.append("["+", ".join([str(int(cl.GetEndPoint(0)[idx])) for idx in range(2)])+"]")
										
										
									voidKey.sort()				
									voidKey = '['+", ".join(voidKey)+']' + ceilingId
										
									voidsMap[curveKey][voidKey] = voidsData	
			if(len(sortedCurveLoops) > 0):
				ceilingsData[ceilingId]["outline"] = curvesMap
				ceilingsData[ceilingId]["voids"] = voidsMap
			
	except Exception as e:
		print e
		continue
	

	
	
# Return the results to the Dynamo Workspace...

outList = json.dumps(outList), json.dumps(ceilingsData)
OUT = outList
# ----------------------------------------
column_types = Python()  # IronPython2
# ---------- column_types.python (215 lines) ----------
##### Imports ######
import sys
sys.path.append("C:\Program Files (x86)\IronPython 2.7\Lib")
import clr
import os
import json
import re

clr.AddReference("RevitServices")
import RevitServices
from RevitServices.Persistence import DocumentManager
doc =  DocumentManager.Instance.CurrentDBDocument

clr.AddReference("RevitAPI")
from Autodesk.Revit.DB import *
from Autodesk.Revit.DB.Visual import *


###### Inputs ######

def IsElementsVisibleInCurrentView(category):
	view = doc.ActiveView
	categoryFilter = ElementCategoryFilter(category)
	collector = FilteredElementCollector( doc, view.Id).WhereElementIsNotElementType().WherePasses(categoryFilter)
	return collector.ToElements()
	
def getVisibleElements(category):
	obj = IsElementsVisibleInCurrentView(category)
	return obj
	
def isclose(a, b, rel_tol=1e-09, abs_tol=0.0):
    return abs(a-b) <= max(rel_tol * max(abs(a), abs(b)), abs_tol)

CATEGORY = BuiltInCategory.OST_Columns
columns = getVisibleElements(CATEGORY)

###### Definitions ######

def convertUnitsTomm(value, unit):
	if UnitTypeId.Inches == unit:
		return value*25.4
	elif UnitTypeId.Centimeters == unit:
		return value*10
	elif UnitTypeId.Feet == unit:
		return value*304.8
	elif UnitTypeId.Millimeters == unit:
		return value
	print unit
	return value




def GetMaterialInfo(mat):
	value = {}
	def GetTextureInformation(texture_path, asset):
		"""
		Get texture information from unifiedBitMap
		"""
		#print asset
		value["path"] = os.path.basename(texture_path)
		if asset.FindByName("texture_RealWorldScaleX") and asset.FindByName("texture_RealWorldScaleY"):
			unitX = asset.FindByName("texture_RealWorldScaleX").GetUnitTypeId()
			unitY = asset.FindByName("texture_RealWorldScaleY").GetUnitTypeId()
			uScale = asset.FindByName("texture_RealWorldScaleX").Value
			vScale = asset.FindByName("texture_RealWorldScaleY").Value
				#print uScale, uScale, unitX.TypeId
			value["uScale"] = convertUnitsTomm(uScale, unitX)
			value["vScale"] = convertUnitsTomm(vScale, unitY)
		else:
			if asset.FindByName("texture_UScale"):
				value["uScale"] = asset.FindByName("texture_UScale").Value
			if asset.FindByName("texture_VScale"):
				value["vScale"] = asset.FindByName("texture_VScale").Value
		if asset.FindByName("texture_UOffset"):
			value["uOffset"] = asset.FindByName("texture_UOffset").Value
		if  asset.FindByName("texture_VOffset"):
			value["vOffset"] = asset.FindByName("texture_VOffset").Value
		if asset.FindByName("texture_WAngle"):
			value["wAng"] = asset.FindByName("texture_WAngle").Value
		
	def getparameterFromAsset(asset):
		"""
		Used for nested Asset
		"""
		
		for i in range(asset.Size):
			#print getRenderingAsset.Get(i).Name
			name = asset.Get(i).Name
			if name == "unifiedbitmap_Bitmap":
				texture_path = asset.FindByName("unifiedbitmap_Bitmap").Value
				if texture_path:
					GetTextureInformation(texture_path, asset)
					return value
	
	appearanceAssetId = mat.AppearanceAssetId
	
	assetElem = doc.GetElement(appearanceAssetId)
	if not assetElem: # return consistent color
		value['diffuseColor'] = [float(mat.Color.Red)/255, float(mat.Color.Green)/255, float(mat.Color.Blue)/255, 1 - float(mat.Transparency)/100]
		value['name'] = mat.Id.ToString()
		return value
	#print assetElem.Name
	
	getRenderingAsset = assetElem.GetRenderingAsset()
	value["name"] = assetElem.Name
	
	property = getRenderingAsset.FindByName("localname")
	if property:
		property = property.Value.ToString()
		value["type"] = property
		# if material class is Glass
		if property == "Glazing":
			GLAZINGCOLOR = ["Clear", "Green", "Gray","Blue", "Bluegreen", "Bronze", "Custom"]
			colorMap = getRenderingAsset.FindByName("glazing_transmittance_color").Value
			glassColor = GLAZINGCOLOR[colorMap]
				
			if glassColor == "Clear":
				value["diffuseColor"] = [0,0,0,0.2]
			elif glassColor == "Green":
				value["diffuseColor"] = [0,1,0,0.2]
			elif glassColor == "Gray":
				value["diffuseColor"] = [0.32, 0.32, 0.32,0.2]
			elif glassColor == "Blue":
				value["diffuseColor"] = [0, 0, 1,0.2]
			elif glassColor == "Bluegreen":
				value["diffuseColor"] = [0.05,0.59,0.73,0.2]
			elif glassColor == "Bronze":
				value["diffuseColor"] = [0.8, 0.5,0.2,0.2]
			else:
				colorMap = getRenderingAsset.FindByName("glazing_transmittance_map").GetValueAsDoubles()
				value["diffuseColor"] = [ i for i in colorMap]
				value["diffuseColor"].append(0.2)
			#print value["diffuseColor"]
			return value
	
	for i in range(getRenderingAsset.Size):
			name = getRenderingAsset.Get(i).Name
			if name == "unifiedbitmap_Bitmap":
				texture_path = asset.FindByName("unifiedbitmap_Bitmap").Value
				if texture_path:
					GetTextureInformation(texture_path, getRenderingAsset)
					#print value		
			property = getRenderingAsset.FindByName(name)
			# diffuse => generic, glazing => glazing class
			isValidProperty = re.search("(?=(diffuse))",property.Name.ToString() ) or re.search(r'(?=(color))',property.Name.ToString()) or re.search(r"(?=(glazing))", property.Name.ToString())
			
				
			if property.NumberOfConnectedProperties > 0 and property.Name.ToString() not in ["common_Tint_color"] and isValidProperty:
			 	
			 	if isinstance(property, AssetPropertyDoubleArray4d):
			 		value["diffuseColor"] = [ i for i in property.GetValueAsDoubles()]
			 		alpha = getRenderingAsset.FindByName("generic_transparency")
			 		if alpha and alpha.Value != 0:
			 			value["diffuseColor"][3] = float(1 - alpha.Value)
				getparameterFromAsset(property.GetAllConnectedProperties()[0])
				
				
			elif isinstance(property, AssetPropertyDoubleArray4d) and property.Name.ToString() not in ["common_Tint_color"] and isValidProperty :
				#print property.Name.ToString(), property.GetValueAsDoubles()
				value["diffuseColor"] = [ i for i in property.GetValueAsDoubles()]
				alpha = getRenderingAsset.FindByName("generic_transparency")
			 	if alpha and alpha.Value != 0:
			 		value["diffuseColor"][3] = float(1 - alpha.Value)
				
				
				
	return value
				

"""
tolist(Object obj1) : Returns Object [ ]
Ensure object is a list. If a single non-iterable object given, then it will be wrapped in a list.
"""
def tolist(obj1):
	if hasattr(obj1,"__iter__"): return obj1
	else: return [obj1]



###### Output ######

outList = []
matList = {}
matMap = []


###### Main Script ######
# Loop through all the given Columns...
for column in columns:
	#print w.Category.Name == "Columns" # columns
	columnId = column.Id.IntegerValue.ToString()
	
	if column.Category.Name == "Columns":
		mat = None
		# get All material Ids associated with column
		mats = column.GetMaterialIds(False)
		if len(mats) > 0:
			mat = doc.GetElement(mats[0])
		if mat:
			if column.Name not in matList:
				#print column.Name.ToString()
				try:
					value = GetMaterialInfo(mat)
				except:
					value = None
				#print typemat, value
				matList[column.Name] = { "value":value}
				matMap.append({column.Name: matList[column.Name]})
		
	
outList = json.dumps(matMap)


OUT = outList
# ----------------------------------------
door_types = Python()  # IronPython2
# ---------- door_types.python (130 lines) ----------
import sys
sys.path.append("C:\Program Files (x86)\IronPython 2.7\Lib")
import clr
clr.AddReference('RevitAPI')
import Autodesk
from Autodesk.Revit.DB import *

clr.AddReference('RevitNodes')
import Revit
clr.ImportExtensions(Revit.GeometryConversion)
clr.ImportExtensions(Revit.Elements)
from Revit.Elements import *

clr.AddReference('RevitServices')
import RevitServices
from RevitServices.Persistence import DocumentManager
from RevitServices.Transactions import TransactionManager

import json
import os

doc = DocumentManager.Instance.CurrentDBDocument

def IsElementsVisibleInCurrentView(category):
	view = doc.ActiveView
	categoryFilter = ElementCategoryFilter(category)
	collector = FilteredElementCollector( doc, view.Id).WhereElementIsNotElementType().WherePasses(categoryFilter)
	return collector.ToElements()
	
def getVisibleElements(category):
	obj = IsElementsVisibleInCurrentView(category)
	return obj
	
def isclose(a, b, rel_tol=1e-09, abs_tol=0.0):
    return abs(a-b) <= max(rel_tol * max(abs(a), abs(b)), abs_tol)

###### Inputs ######

CATEGORY = BuiltInCategory.OST_Doors
items = getVisibleElements(CATEGORY)
if not hasattr(items, '__iter__'):
	items = [items]
	
def checkIfPointExist(currentLine, allLines):
	for line in allLines:
		startPoint = line.GetEndPoint(0)
		endPoint = line.GetEndPoint(1)
		currentStartPoint = currentLine.GetEndPoint(0)
		currentEndPoint = currentLine.GetEndPoint(1)
		if ( round(startPoint[0],3) == round(currentStartPoint[0],3) and round(startPoint[1],3) == round(currentStartPoint[1],3) and round(endPoint[0],3) == round(currentEndPoint[0],3) and round(endPoint[1],3) == round(currentEndPoint[1],3)) or (round(endPoint[0],3) == round(currentStartPoint[0],3) and round(endPoint[1],3) == round(currentStartPoint[1],3) and round(startPoint[0],3) == round(currentEndPoint[0],3) and round(startPoint[1],3) == round(currentEndPoint[1],3)):
		 return False
		
	return True	

opt = Options()
opt.IncludeNonVisibleObjects = False
doorTypes = set()
doorData = {}
doorsWallMap = {}
for i in items:
	geoData = []
	try:
		doorID = i.Id.ToString()
		door = i.Name + " "+ i.Symbol.FamilyName 
		# facing flipped, handflipped == t,t or f,f => symbol same in both case. True for flipped, handflipped = t,f or f,t
		if i.FacingFlipped == i.HandFlipped:
			door += " 0"
		else:
			door += " 1"
		
		allLines = []
		# If element has associated plan view use that else get active 3d view
		try:
			viewId = doc.GetElement(i.LevelId).FindAssociatedPlanViewId()
		except:
			viewId = -1
		if str(viewId) == "-1":
			view = doc.ActiveView
		else:
			view = doc.GetElement(viewId)
		opt.View = view
	
		geoEle = i.get_Geometry(opt)
		for geoInstance in geoEle:
			# get symbol geometry of geominstance
			for symbIns in geoInstance.GetSymbolGeometry():
				if isinstance(symbIns, Line):
					lines = symbIns
					geoData.append({"type":"Line","startPoint":[lines.GetEndPoint(0)[idx]*304.8 for idx in range(3)], "endPoint":[lines.GetEndPoint(1)[idx]*304.8 for idx in range(3)]})
					
						
				elif isinstance(symbIns, Arc):
					arcPoints = symbIns.Tessellate()
					points = []
					for arcPoint in arcPoints:
						points.append([arcPoint[idx]* 304.8 for idx in range(3)])
					geoData.append({"type":"Arc","points":points})
					
					
						
				elif isinstance(symbIns, Solid):
					solid = symbIns
						
					for edge in solid.Edges:
						edge = edge.AsCurve()
						if isinstance(edge, Line):
							lines = edge
							# check line exists already in symbol as 2D line ignoring(z)
							if checkIfPointExist(lines, allLines) and lines.GetEndPoint(0)[2] == lines.GetEndPoint(1)[2]:
								allLines.append(lines)
								geoData.append({"type":"Line","startPoint":[lines.GetEndPoint(0)[idx]*304.8 for idx in range(3)], "endPoint":[lines.GetEndPoint(1)[idx]*304.8 for idx in range(3)]})

						if isinstance(edge, Arc):
							arcs = edge
	except Exception as e:
		print e
		continue
		
	doorData[doorID] = geoData
	
# get host of the door
for i in items:
	if i.Host:
		doorsWallMap[i.Id.ToString()] = i.Host.Id.ToString()
	
	

OUT= json.dumps(doorData), json.dumps(doorsWallMap)
#OUT = [json.dumps(doorData)]
#OUT = doorMeshMaterialInfo
# ----------------------------------------
window_types = Python()  # IronPython2
# ---------- window_types.python (124 lines) ----------
import clr
clr.AddReference('RevitAPI')
import Autodesk
from Autodesk.Revit.DB import *

clr.AddReference('RevitNodes')
import Revit
clr.ImportExtensions(Revit.GeometryConversion)
clr.ImportExtensions(Revit.Elements)
from Revit.Elements import *

clr.AddReference('RevitServices')
import RevitServices
from RevitServices.Persistence import DocumentManager
from RevitServices.Transactions import TransactionManager

import json

doc = DocumentManager.Instance.CurrentDBDocument

def IsElementsVisibleInCurrentView(category):
	view = doc.ActiveView
	categoryFilter = ElementCategoryFilter(category)
	collector = FilteredElementCollector( doc, view.Id).WhereElementIsNotElementType().WherePasses(categoryFilter)
	return collector.ToElements()
	
def getVisibleElements(category):
	obj = IsElementsVisibleInCurrentView(category)
	return obj
	
def isclose(a, b, rel_tol=1e-09, abs_tol=0.0):
    return abs(a-b) <= max(rel_tol * max(abs(a), abs(b)), abs_tol)

###### Inputs ######

CATEGORY = BuiltInCategory.OST_Windows
items = getVisibleElements(CATEGORY)

if not hasattr(items, '__iter__'):
	items = [items]
	
def checkIfPointExist(currentLine, allLines):
	for line in allLines:
		startPoint = line.GetEndPoint(0)
		endPoint = line.GetEndPoint(1)
		currentStartPoint = currentLine.GetEndPoint(0)
		currentEndPoint = currentLine.GetEndPoint(1)
		if ( round(startPoint[0],3) == round(currentStartPoint[0],3) and round(startPoint[1],3) == round(currentStartPoint[1],3) and round(endPoint[0],3) == round(currentEndPoint[0],3) and round(endPoint[1],3) == round(currentEndPoint[1],3)) or (round(endPoint[0],3) == round(currentStartPoint[0],3) and round(endPoint[1],3) == round(currentStartPoint[1],3) and round(startPoint[0],3) == round(currentEndPoint[0],3) and round(startPoint[1],3) == round(currentEndPoint[1],3)):
		 return False
		
	return True	

opt = Options()
opt.IncludeNonVisibleObjects = False
opt.View = doc.ActiveView
windowTypes = set()
windowData = {}
windowsWallMap = {}

for i in items:
	geoData = []
	try:
		id = i.Id.ToString()
		window = i.Name + " "+ i.Symbol.FamilyName 
		# facing flipped, handflipped == t,t or f,f => symbol same in both case. True for flipped, handflipped = t,f or f,t
		if i.FacingFlipped == i.HandFlipped:
			window += " 0"
		else:
			window += " 1"
		
		allLines = []
		# If element has associated plan view use that else get active 3d view
		try:
			viewId = doc.GetElement(i.LevelId).FindAssociatedPlanViewId()
		except:
			viewId = -1
		if str(viewId) == "-1":
			view = doc.ActiveView
		else:
			view = doc.GetElement(viewId)
		opt.View = view

	
		geoEle = i.get_Geometry(opt)
		for geoInstance in geoEle:
			# get symbol geometry of geominstance
			for symbIns in geoInstance.GetSymbolGeometry():
				if isinstance(symbIns, Line):
					lines = symbIns
					geoData.append({"type":"Line","startPoint":[lines.GetEndPoint(0)[idx]*304.8 for idx in range(3)], "endPoint":[lines.GetEndPoint(1)[idx]*304.8 for idx in range(3)]})
					
						
				elif isinstance(symbIns, Arc):
					arcPoints = symbIns.Tessellate()
					points = []
					for arcPoint in arcPoints:
						points.append([arcPoint[idx]* 304.8 for idx in range(3)])
					geoData.append({"type":"Arc","points":points})
						
				elif isinstance(symbIns, Solid):
					solid = symbIns
					
					for edge in solid.Edges:
						edge = edge.AsCurve()
						if isinstance(edge, Line):					
							lines = edge
							# check line exists already in symbol as 2D line ignoring(z)
							if checkIfPointExist(lines, allLines) and lines.GetEndPoint(0)[2] == lines.GetEndPoint(1)[2]:
								#print " Solid Lines:"
								allLines.append(lines)
								geoData.append({"type":"Line","startPoint":[lines.GetEndPoint(0)[idx]*304.8 for idx in range(3)], "endPoint":[lines.GetEndPoint(1)[idx]*304.8 for idx in range(3)]})
								
						if isinstance(edge, Arc):
							arcs = edge
	except:
		continue
	windowData[id] = geoData

# get host of the windows
for i in items:
	if i.Host:
		windowsWallMap[i.Id.ToString()] = i.Host.Id.ToString()
		
OUT=json.dumps(windowData), json.dumps(windowsWallMap)
# ----------------------------------------
python_script = Python()  # IronPython2
# ---------- python_script.python (187 lines) ----------
# Load the Python Standard and DesignScript Libraries
import sys
sys.path.append("C:\Program Files (x86)\IronPython 2.7\Lib")
# Load the Python Standard and DesignScript Libraries
import sys
import clr
import json
clr.AddReference('ProtoGeometry')
from Autodesk.DesignScript.Geometry import *


clr.AddReference("RevitAPIIFC")
clr.AddReference("RevitAPI")
from Autodesk.Revit.DB import *
from Autodesk.Revit.DB.Visual import *
from Autodesk.Revit.DB.IFC import *

clr.AddReference('RevitServices')
import RevitServices
from RevitServices.Persistence import DocumentManager
from RevitServices.Transactions import TransactionManager
from System.Collections.Generic import Dictionary

doc = DocumentManager.Instance.CurrentDBDocument
view = doc.ActiveView
# The inputs to this node will be stored as a list in the IN variables.

ITEM_LIMIT = 150

CATEGORY = [BuiltInCategory.OST_Levels, BuiltInCategory.OST_Walls, BuiltInCategory.OST_Floors, BuiltInCategory.OST_Columns,BuiltInCategory.OST_Railings]

def IsElementsVisibleInCurrentView(category):
	view = doc.ActiveView
	categoryFilter = ElementCategoryFilter(category)
	collector = FilteredElementCollector( doc, view.Id).WhereElementIsNotElementType().WherePasses(categoryFilter)
	return collector.ToElements()
	
def getVisibleElements( category):
	obj = IsElementsVisibleInCurrentView(category)
	return obj
	
def tolist(obj):
	if hasattr(obj,"__iter__"):return obj
	else:
		return [obj]
	
# get Elements present
levels = FilteredElementCollector(doc).OfCategory(CATEGORY[0]).WhereElementIsNotElementType().ToElements()
walls = getVisibleElements(CATEGORY[1] )
floors = getVisibleElements(CATEGORY[2] )
columns = getVisibleElements(CATEGORY[3] )
# temp fix for railing => not coming in filteredCollector
# category != BuiltInCategory.OST_Railings 
# revit.elements.unknownelement


elementsList = [levels, walls, floors,columns ] 

singleFurnitureList = []
furnitureSetMap = {}
filteredFurnitures = []
directFurnitureData = []
debug = []



###### Inputs ######

names = {0:"levels", 1:"walls", 2:"floors",  3:"columns" }


data = {}
outlist = []

keys = []
opt = Options()
def getHeightFromBoundingBox(element):
	bbox = element.get_BoundingBox(view)
	if bbox :
		rightUpperCorner = [bbox.Max[idx]*304.8 for idx in range(3)]
		leftBottomCorner = [bbox.Min[idx]*304.8 for idx in range(3)]
		#print "MAX", rightUpperCorner
		#print "MIN", leftBottomCorner
			
		height = rightUpperCorner[2] - leftBottomCorner[2]
			#print "boundingBox:", center
		return height
	else:
			
		return 0
def getColumnData(column):
	noOfFaces = 0
	def handleSolid(solid, noOfFaces):
			columnBottomFace = []
			#print solid.Faces.Size
			for f in solid.Faces:
				if (f.ComputeNormal(UV(0.5,0.5)).Z < 0):
					noOfFaces += 1
					#if True: to get bottom face
					edges = f.GetEdgesAsCurveLoops()
					sortedCurveLoops = ExporterIFCUtils.SortCurveLoops(edges);
					if len(sortedCurveLoops) > 1:
						noOfFaces += 1
					for e in edges:
						for cl in e.GetCurveLoopIterator():
							try:
								if isinstance(cl, Arc):
									points = cl.Tessellate()
									for point in points:
										columnBottomVertices.append([point[idx]* 304.8 for idx in range(3)])
								else:
									columnBottomVertices.append([cl.GetEndPoint(0)[idx]* 304.8 for idx in range(3)])
							except Exception as e:
								print e
					break
			return columnBottomFace, noOfFaces
				
	columnBottomVertices = []
	for geo in column.get_Geometry(opt):
		if isinstance(geo, Solid):
				bottomFace, noOfFaces = handleSolid(geo, noOfFaces)
				columnBottomVertices += bottomFace
		if isinstance(geo, GeometryInstance):
			transform = column.GetTransform()
			for g in geo.GetInstanceGeometry():
				if isinstance(g, Solid):
					bottomFace, noOfFaces = handleSolid(g, noOfFaces)
					
					columnBottomVertices += bottomFace	
				
	#print "column",noOfFaces, len(columnBottomVertices), columnBottomVertices, 
	height = 0
	if column.get_Parameter(BuiltInParameter.INSTANCE_LENGTH_PARAM):
		height = column.get_Parameter(BuiltInParameter.INSTANCE_LENGTH_PARAM).AsDouble()*304.8
	if height == 0:
		height = getHeightFromBoundingBox(column)
		
	return columnBottomVertices, height, noOfFaces
				
	

# get map of names and element
for i in range(0,len(elementsList)):
 	num = 1
 	key = names[i] + "-" +str(num)
	if i == 3:
		for element in range(0,len(elementsList[i]), ITEM_LIMIT):
			start = element
			end = element + ITEM_LIMIT if element + ITEM_LIMIT < len(elementsList[i]) else len(elementsList[i])
			columns = []
			for ele in range(start, end):
				column = elementsList[i][ele]
				columnId = column.Id.ToString()
				columnBottomVertices, height, noOfFaces = getColumnData(column)
				#print noOfFaces
				createWithGeometry = True if noOfFaces > 1 else False
				c = json.dumps({"type": column.Name.ToString(),  "height": height,"columnBottomFace" : columnBottomVertices, "elementId": columnId, "createWithGeometry" : createWithGeometry})
				columns.append(c)
				#print "--"*10
				
			data[key] = columns
			keys.append(key)
			num += 1
			key =  names[i] + "-" +str(num)
	else:
		for element in range(0,len(elementsList[i]), ITEM_LIMIT):

			data[key] = []
			start = element
			end = element + ITEM_LIMIT if element + ITEM_LIMIT < len(elementsList[i]) else len(elementsList[i])	
			for elem in range(start, end):
				data[key].append(elementsList[i][elem])
			keys.append(key)
			num += 1
			key =  names[i] + "-" +str(num)

			

#outlist = [{"metadata" : json.dumps(keys)}]

for key, value in data.items():
	print key, len(data[key])
	d = Dictionary[str, object]({key:value})
	outlist.append(d)

# Assign your output to the OUT variable.
OUT =  outlist
# ----------------------------------------
revit_export = Python()  # IronPython2
# ---------- revit_export.python (1086 lines) ----------
import sys
sys.path.append("C:\Program Files (x86)\IronPython 2.7\Lib")
import clr
import json
import os
import re
import math
from math import pi
clr.AddReference("RevitAPI")
clr.AddReference("RevitAPIIFC")
from Autodesk.Revit.DB import *
from Autodesk.Revit.DB.Visual import *
from Autodesk.Revit.DB.IFC import *

clr.AddReference("RevitServices")

import RevitServices
from RevitServices.Persistence import DocumentManager
doc =  DocumentManager.Instance.CurrentDBDocument

options = Options()
view = doc.ActiveView
debug = []
# Place your code below this line

class Stack:
	def __init__(self):
		self.__list = []
	def Push(self, item):
		self.__list.append(item)
	def Pop(self):
		return self.__list.pop()
	def Peek(self):
		return self.__list[-1]
		
class myContextExport(IExportContext):
	transformationStack = Stack()
	
	
	def __init__(self, doc):
		self.doc = doc
		self._primaryDocument = doc
		self.transformationStack.Push( Transform.Identity )
		self.familyData = {"Doors": {}, "Furniture":{}, "Floors":{}, "Windows" : {}, "Railings" : {}, "Security Devices":{}, "Fire Alarm Devices":{}, "Communication Devices":{}, "Lighting Fixtures":{}, "Casework" : {}, "Furniture Systems":{}, "Planting" :{}, "Electrical Fixtures":{}, "Data Devices": {}, "Lighting Devices":{}, "Specialty Equipment":{}, "RVT Links":{}, "Curtain Wall Mullions" : {},"Curtain Panels": {},"Stairs":{}, "Structural Columns" :{},"Generic Models":{}, "Assemblies":{}, "Model Groups":{},"Ducts": {}, "Duct Fittings":{}, "Flex Ducts":{}, "Cable Trays" : {}, "Air Terminals" : {}, "Mechanical Equipment" : {}, "Cable Tray Fittings" : {}, "Duct Accessories":{}, "Top Rails": {}, "Ramps":{}, "Mass" : {},  "Plumbing Fixtures":{},"Pipes":{}, "Pipe Fittings":{}, "Conduit Fittings": {}, "Conduits":{}, "Electrical Equipment":{}, "Sprinklers":{}, "Structural Framing" :{}, "Columns" : {}, "Walls":{}  }
		
		self.data = {"Doors": {}, "Furniture":{}, "Floors":{}, "Windows" : {}, "Railings" : {}, "Security Devices":{}, "Fire Alarm Devices":{}, "Communication Devices":{}, "Lighting Fixtures":{}, "Casework" : {},"Furniture Systems":{}, "Planting":{},"Electrical Fixtures":{},"Data Devices": {}, "Lighting Devices" :{}, "Specialty Equipment":{}, "RVT Links":{}, "Curtain Wall Mullions" : {},"Curtain Panels": {},"Stairs":{}, "Structural Columns" :{}, "Generic Models":{}, "Assemblies":{}, "Model Groups":{},"Ducts": {}, "Duct Fittings":{}, "Flex Ducts":{}, "Cable Trays" : {}, "Air Terminals" : {}, "Mechanical Equipment" : {}, "Cable Tray Fittings" : {}, "Duct Accessories":{}, "Top Rails": {}, "Ramps":{}, "Mass" : {}, "Plumbing Fixtures":{},"Pipes":{}, "Pipe Fittings":{}, "Conduit Fittings": {}, "Conduits":{}, "Electrical Equipment":{}, "Sprinklers":{}, "Structural Framing" :{}, "Columns" : {}, "Walls":{} }
		
		self.creationData = {"Doors": {}, "Furniture":{}, "Floors":{}, "Windows" : {}, "Railings" : {}, "Security Devices":{}, "Fire Alarm Devices":{}, "Communication Devices":{}, "Lighting Fixtures":{}, "Casework" : {}, "Furniture Systems":{}, "Planting": {}, "Electrical Fixtures":{}, "Data Devices": {}, "Lighting Devices": {}, "Specialty Equipment":{},"RVT Links":{}, "Curtain Wall Mullions" : {},"Curtain Panels": {},"Stairs":{}, "Structural Columns" :{},"Generic Models":{},"Assemblies":{}, "Model Groups":{},"Ducts": {}, "Duct Fittings":{}, "Flex Ducts":{}, "Cable Trays" : {}, "Air Terminals" : {}, "Mechanical Equipment" : {}, "Cable Tray Fittings" : {}, "Duct Accessories":{}, "Top Rails": {}, "Ramps":{}, "Mass" : {}, "Plumbing Fixtures":{},"Pipes":{}, "Pipe Fittings":{}, "Conduit Fittings": {}, "Conduits":{}, "Electrical Equipment":{}, "Sprinklers":{}, "Structural Framing" :{}, "Columns" : {} , "Walls":{}  }
		
		self._MEPList = ["Ducts", "Duct Fittings", "Flex Ducts", "Cable Trays", "Cable Tray Fittings", "Duct Accessories",  "Air Terminals", "Pipes", "Pipe Fittings", "Conduit Fittings", "Conduits"] 
		self._familyList = set()
		self._currentFamilyElement = {"name" : "", "category" : "", "materials": [] }
		
		self._categoryList = ["Furniture", "Casework", "Doors", "Windows", "FurnitureSystems_single", "Security Devices", "Fire Alarm Devices", "Communication Devices", "Lighting Fixtures", "Furniture Systems","Planting","Electrical Fixtures", "Data Devices", "Lighting Devices", "Specialty Equipment","Stairs", "Curtain Panels", "Curtain Wall Mullions","Generic Models","Assemblies", "Model Groups", "Mechanical Equipment", "Railings", "Top Rails", "Ramps", "Plumbing Fixtures","Electrical Equipment", "Sprinklers" ]
		
		self._currentLink = {"name":""}
		self._linkCategory = ["Floors", "Walls", "Specialty Equipment", "Doors", "Windows", "Stairs", "Curtain Wall Mullions",      "Curtain Panels", "Structural Columns", "Communication Devices",  "Furniture", "Casework","Generic Models", "Lighting Devices", "Lighting Fixtures", "Ceilings", "Columns", "Air Terminals", "Mechanical Equipment", "Ducts", "Duct Fittings", "Flex Ducts", "Cable Trays", "Cable Tray Fittings", "Duct Accessories", "Top Rails","Railings", "Ramps", "Structural Framing" ]
		self._currentLinkElement = {"name":{}, "category":{},"materials": []}
		
		self._linkKeys = []
		
		self._isRevitLink = False
		self.debugList = []
		
		
		self._currentMaterialId = "-1"
	def Start(self):
		print "Start"
		return True
	
	def Finish(self):
		print "Finish"
		
	def IsCanceled(self):
		return False
		
	def OnViewBegin(self, node):
		return RenderNodeAction.Proceed
	
	def OnViewEnd(self, node):
		pass
	
	def OnLinkBegin(self, node):
		#print node
		self._isRevitLink = True
		#print "isRevitLink", self._isRevitLink
		self.doc = node.GetDocument()
		#name = node.NodeName
		name = self.doc.Title.replace(".", "")
		
		category = "RVT Links"
		self._currentLink["name"] = name
		self._currentLink["category"] = category
		self.transformationStack.Push(self.CurrentTransform().Multiply( node.GetTransform() ))
		

		if name not in self._linkKeys:
			self._linkKeys.append(name)
		else:
			self._isRevitLink = False
			return RenderNodeAction.Skip
			
		if self._isRevitLink:
			self.data[category][name] = {}
			for cat in self._linkCategory:
				self.data[category][name][str(cat)] = {}
		
		#self._data["RVT Links"][name] = {}
		#self._data[category]
		
		
		return RenderNodeAction.Proceed
		
		
	def OnLinkEnd(self, node):
		self.doc = self._primaryDocument
		self._currentLink = {"name":"", "category":""}
		self._isRevitLink = False
		self.transformationStack.Pop()
		print "endLink"
		
	
	def OnElementBegin(self, elementId):
		self._currentFamilyElement = {"name" : "", "category" : "", "materials": [] }
		self._currentMaterialId = "-1"
		element = self.doc.GetElement(elementId)
		category = element.Category.Name.ToString()
		eId = elementId.IntegerValue.ToString()
		
		level = self.doc.GetElement(element.LevelId)
		
		#print category
		if level:
			levelName = level.Name
		else:
			levelName = None
		
		#if category not in self._categoryList and category not in self.debugList:
			#print category, eId
			#self.debugList.append(category)
		#print category
		if self._isRevitLink:
			if category in self._linkCategory:
				try:
					familyName = element.Symbol.FamilyName.ToString()
				except:
					familyName = ""
				typeOfElement = element.Name.ToString()
				self._currentMaterialId = -1
				self._currentLinkElement["name"] = eId
				self._currentLinkElement["category"] = category
				self._currentLinkElement["materials"] = []
				linkCategory = self._currentLink["category"]
				linkName = self._currentLink["name"]
				self.data[linkCategory][linkName][category][eId] = {}
				try:
					
					print element.GetTransform().Origin
					origin = [element.GetTransform().Origin[idx] for idx in range(3)]
					
				except Exception as e:
					print e
					origin = [0,0,0]
				self.data[linkCategory][linkName][category][eId]["data"] = {"category": category, "family": familyName, "type":typeOfElement, "elementId": eId, "levelName":levelName, "center": origin}
				return RenderNodeAction.Proceed
			else:
				
				return RenderNodeAction.Skip
				
		if category == "RVT Links":
			return RenderNodeAction.Proceed
			
		if category in ["Stairs", "Curtain Panels", "Curtain Wall Mullions", "Railings", "Top Rails", "Ramps", "Structural Framing", "Columns"] or category in self._MEPList or (element.GetType().ToString() in ["Autodesk.Revit.DB.FamilyInstance"] and category in ["Floors", "Walls"]) or category in ["Parts"]:
			try:
				familyName = element.Symbol.FamilyName.ToString()
			except:
				familyName = ""
			name = eId
			typeOfElement = element.Name.ToString()
			if category in ["Floors", "Walls","Parts"]:
				category = "Mass"
			self.data[category][eId] = { }
			self._currentFamilyElement["name"] = eId
			self._currentFamilyElement["category"] = category
			self.data[category][name] = {}
			try:
				origin = self.getCenterFromBoundingBox(element, category)
				#print origin
			except Exception as e:
				origin = [0,0,0]
			self.data[category][name]["data"] = { "category": category, "family": familyName, "type":typeOfElement, "elementId": eId, "levelName":levelName, "center":origin  }
			return RenderNodeAction.Proceed
		
		elif category == "Walls":
			baseLine = element.Location.Curve
			if isinstance(baseLine, Arc):
				try:
					familyName = element.Symbol.FamilyName.ToString()
				except:
					familyName = ""
				name = eId
				typeOfElement = element.Name.ToString()
				self.data[category][eId] = { }
				self._currentFamilyElement["name"] = eId
				self._currentFamilyElement["category"] = category
				self.data[category][name] = {}
				try:
					origin = self.getCenterFromBoundingBox(element, category)
					#print origin
				except Exception as e:
					origin = [0,0,0]
				self.data[category][name]["data"] = { "category": category, "family": familyName, "type":typeOfElement, "elementId": eId, "levelName":levelName, "center":origin  }
				
				#print baseLine
				return RenderNodeAction.Proceed
			else:
				return RenderNodeAction.Skip
			
		elif category == "Structural Columns":
			try:
				familyName = element.Symbol.FamilyName.ToString()
			except:
				familyName = ""
			name = eId
			typeOfElement = element.Name.ToString()
			self.data[category][eId] = { }
			self._currentFamilyElement["name"] = eId
			self._currentFamilyElement["category"] = category
			self.data[category][name] = {}
			self.data[category][name]["data"] = { "category": category, "family": familyName, "type":typeOfElement, "elementId": eId, "levelName":levelName }
			columnBottomFace, height, materialInfo, noOfFaces = self.handleColumns(element)
			self.data[category][name]["data"]["height"] = height
			self.data[category][name]["data"]["bottomFace"] =  columnBottomFace
			self.data[category][name]["data"]["materialInfo"] = materialInfo
			self.data[category][name]["data"]["createWithGeometry"] = True if noOfFaces > 1 else False
			
			if noOfFaces > 1:
				return RenderNodeAction.Proceed
			else:
				return RenderNodeAction.Skip
			
			
		
		elif category in self._categoryList:
			center = self.getCenterFromBoundingBox(element, category)
			family, typeofElement = self.getFamilyAndType(element)
			basePoint = [0,0,0]
			rotation = 0
			isFaceFlipped = None
			width = 0
			height = 0
			offset = 0
			length = 0
			try:
				basePoint, rotation, isFaceFlipped, isHandFlipped, width, height, offset, length = self.getRequiredPropertiesFromElement(element, category)
			except Exception as e:
				print e
			
			superComponent = None
			try: # normal furniture or furniture system
				superComponent = element.SuperComponent.Id
			except:
				pass
				
			if not superComponent:# for assemblies
				try:
					superComponent = None if element.AssemblyInstanceId.ToString() == "-1" else element.AssemblyInstanceId
				except:
					pass
			if not superComponent: # for model groups
				try:
					superComponent = None if element.GroupId.ToString() == "-1" else element.GroupId
				except:
					pass
			try:
				if superComponent and category in ["Doors", "Windows"]:
					superCategory = self.doc.GetElement(superComponent).Category.Name.ToString()
					if superCategory not in ["Doors", "Windows"]:
						superComponent = None
			except Exception as e:
				print e
			if not superComponent:
				if category in ["Assemblies", "Model Groups"]:
					subComponents = [elem.ToString() for elem in element.GetDependentElements(None)]
				else:
					try: 
						subComponents = [elem.ToString() for elem in element.GetSubComponentIds()]
					except:
						subComponents = []
				self.creationData[category][eId] = {"subComponents" : subComponents}
				
				
			try:
				isMirrored = element.Mirrored
			except:
				isMirrored = False
			
			self.data[category][eId] = {"basePoint": basePoint, "rotation": rotation, "isFaceFlipped": isFaceFlipped,"width":width, "height": height, "family": family, "type": typeofElement,"bbCenter": center, "category": category, "offset": offset, "length": length, "levelName":levelName, "mirrored": isMirrored, "isHandFlipped":isHandFlipped  }
			
			if category in ["Doors","Windows"]:
				self.data[category][eId]["HandOrientation"] = [element.HandOrientation[idx] for idx in range(3)]
				
				self.data[category][eId]["FacingOrientation"] = [element.FacingOrientation[idx] for idx in range(3)]
				
				
			name = self.getNameForFamilyInstance(typeofElement, family,width, height, isFaceFlipped)
			
			opt = Options()
			opt.View = doc.ActiveView
			geometry =  element.get_Geometry(opt)
			totalFaces = 0
			for geo in geometry:
				if isinstance(geo, Solid):
					totalFaces += geo.Faces.Size
				if isinstance(geo, GeometryInstance ):
					instanceGeometry = geo.GetInstanceGeometry()
					for instanceGeom in instanceGeometry:
						if( isinstance(instanceGeom, Solid)):
							totalFaces += instanceGeom.Faces.Size							
			try:
				previousTotalFaces = self.familyData[category][name]["data"]["totalFaces"]
			except : 
				previousTotalFaces = 0
			if totalFaces > previousTotalFaces or (totalFaces == 0 and previousTotalFaces == 0):
				self._currentFamilyElement["name"] = name
				self._currentFamilyElement["category"] = category
				self._familyList.add(name)
				self.familyData[category][name] = {}
				self.familyData[category][name]["data"] = {"rotation": rotation, "isFaceFlipped": isFaceFlipped, "basePoint": basePoint, "bbCenter": center, "totalFaces": totalFaces, "mirrored": isMirrored, "isHandFlipped":isHandFlipped }
				return RenderNodeAction.Proceed
			else:
				return RenderNodeAction.Skip
		
				
		elif category in ["Floors", "Autodesk.Revit.DB.Floor"] and element.GetType().ToString() in ["Floors", "Autodesk.Revit.DB.Floor"] :
			typeOfFloor = element.Name.ToString()
			family = element.LookupParameter("Family").AsValueString()
			level = self.doc.GetElement(element.LevelId)
			if level:
				levelName = level.Name
			else:
				levelName = None
			try:
				bottomProfileRef =  HostObjectUtils.GetBottomFaces(element)
			except Exception as e:
				print e
			isVoidsPresent = False
			bottomProfile = element.GetGeometryObjectFromReference(bottomProfileRef[0])
			FaceNormal =  bottomProfile.FaceNormal
			opt = Options()
			opt.View = self.doc.ActiveView
			geometry = element.get_Geometry(opt)
			sortedCurveLoops = []
			for geo in geometry:
				if isinstance(geo, Solid):
					for f in geo.Faces:
						try:
							currentFaceNormal = f.FaceNormal
						except:
							currentFaceNormal = [0,0,0]
						areSameNormal = currentFaceNormal[2] ==  FaceNormal[2] and currentFaceNormal[1] ==  FaceNormal[1] and currentFaceNormal[0] ==  FaceNormal[0] 
						if areSameNormal:
							curveLoops = f.GetEdgesAsCurveLoops()
							sortedCurveLoops = ExporterIFCUtils.SortCurveLoops(curveLoops)
							
							curvesMap = {}
							voidsMap = {}
							for sortedcurveLoop in sortedCurveLoops:
								curveLoop = sortedcurveLoop[0]
								curveData = []
								curveIds = []
								curveKey = []
								for cl in curveLoop.GetCurveLoopIterator():
									if isinstance(cl, Arc): 
										points = cl.Tessellate()
										
										for i in range(len(points)-1):
											#print "arc", [points[i][idx] for idx in range(3)]
											curveData.append([points[i][idx]* 304.8 for idx in range(3)])
										curveKey.append("["+", ".join([str(int(cl.GetEndPoint(0)[idx])) for idx in range(2)])+"]")
									elif isinstance(cl, Line):
										#print [cl.GetEndPoint(0)[idx] for idx in range(3)]
										curveData.append([cl.GetEndPoint(0)[idx]* 304.8 for idx in range(3)])

										curveKey.append("["+", ".join([str(int(cl.GetEndPoint(0)[idx])) for idx in range(2)])+"]")
									
								curveKey.sort()	
								curveKey = '['+", ".join(curveKey)+']' + eId
								
								curvesMap[str(curveKey)] = curveData	
								if len(sortedcurveLoop) > 1:	
									voidsMap[curveKey] = {}
								for voidLoopId in range(1,len(sortedcurveLoop)):
									voidLoop = sortedcurveLoop[voidLoopId]
									#print voidLoop
									isVoidsPresent = True
									voidsData = []
									voidKey = []
									for cl in voidLoop.GetCurveLoopIterator():
										try:
											if isinstance(cl, Arc): 
												points = cl.Tessellate()
												for i in range(len(points)-1):
													voidsData.append([points[i][idx]* 304.8 for idx in range(3)])
												voidKey.append("["+", ".join([str(int(cl.GetEndPoint(0)[idx])) for idx in range(2)])+"]")
												continue
										except Exception as e:
											print e
											continue
											
										voidsData.append([cl.GetEndPoint(0)[idx]* 304.8 for idx in range(3)])
										voidKey.append("["+", ".join([str(int(cl.GetEndPoint(0)[idx])) for idx in range(2)])+"]")
									
									
									voidKey.sort()				
									voidKey = '['+", ".join(voidKey)+']' + eId
									
									voidsMap[curveKey][voidKey] = voidsData
								

			if(len(sortedCurveLoops) > 0):
				self.familyData[category][eId] = { }
				self._currentFamilyElement["name"] = eId
				self._currentFamilyElement["category"] = category
				self.familyData[category][eId] = {"outline":curvesMap, "voids":voidsMap, "type":typeOfFloor, "family":family, "level":levelName }
				if isVoidsPresent:
					return RenderNodeAction.Proceed
				else:
					return RenderNodeAction.Skip
			else:
				return RenderNodeAction.Skip
			
		else:
			return RenderNodeAction.Skip
		
		
			
		
			
	def handleFace(self, f):
		faceVertices = []
		edges = f.GetEdgesAsCurveLoops()
		edges = ExporterIFCUtils.SortCurveLoops(edges)
		for e in edges:
			for cl in e.GetCurveLoopIterator():
				try:
					if isinstance(cl, Arc):
						points = cl.Tessellate()
						for point in points:
							faceVertices.append([point[idx]* 304.8 for idx in range(3)])
					else:
						faceVertices.append([cl.GetEndPoint(0)[idx]* 304.8 for idx in range(3)])
				except Exception as e:
					print e	
		return faceVertices

		
	def OnElementEnd(self, elementId):
		pass
	
	def OnInstanceBegin(self, node):
		self.transformationStack.Push( self.CurrentTransform().Multiply(node.GetTransform()))
		return RenderNodeAction.Proceed
		
	
	def OnInstanceEnd(self, node):
		self.transformationStack.Pop()
		
	def OnFaceBegin(self, node):
		return RenderNodeAction.Proceed
	
	def OnFaceEnd(self, node):
		pass
		
	def OnLight(self, node):
		pass
		
	def OnRPC(self, node):
		pass
		
	def OnMaterial(self, node):
		materialId = node.MaterialId.ToString()
		self._currentMaterialId = materialId
		name = self._currentFamilyElement["name"]
		category = self._currentFamilyElement["category"]
	
		if self._isRevitLink:
			name = self._currentLinkElement["name"]
			category = self._currentLinkElement["category"]
			linkCategory = self._currentLink["category"]
			linkName = self._currentLink["name"]
			if materialId not in self._currentLinkElement["materials"]:
				self._currentLinkElement["materials"].append(node.MaterialId.ToString())
				self.data[linkCategory][linkName][category][name][materialId] = {}
				self.data[linkCategory][linkName][category][name][materialId]["materialInfo"] = {}
				material = self.doc.GetElement(node.MaterialId)
				if material:
					try:
						value = self.GetMaterialInfo(material)
						
					except:
						value = None
					#self._data[category][name][materialId]["materialInfo"]["type"] = typeMat
					self.data[linkCategory][linkName][category][name][materialId]["materialInfo"]["value"] = value
				else:
					# if material is not there, get consistent color
					c = node.Color
					self.data[linkCategory][linkName][category][name][materialId]["materialInfo"]["value"] = {"diffuseColor":[int(c.Red), int(c.Green), int(c.Blue),node.Transparency ]}
					
		elif materialId not in self._currentFamilyElement["materials"] and (category in ["Stairs", "Curtain Panels", "Curtain Wall Mullions","Railings", "Top Rails", "Ramps", "Structural Framing", "Columns", "Walls"] or category in self._MEPList or (category == "Mass")):
			self._currentFamilyElement["materials"].append(materialId)
			self.data[category][name][materialId] = {}
			self.data[category][name][materialId]["materialInfo"] = {}
			material = self.doc.GetElement(node.MaterialId)
			if material:
				try:
					value = self.GetMaterialInfo(material)
				except:
					value = None
				self.data[category][name][materialId]["materialInfo"]["value"] = value
			else:
				# if material is not there, get consistent color
				c = node.Color
				self.data[category][name][materialId]["materialInfo"]["value"] = {"diffuseColor":[int(c.Red), int(c.Green), int(c.Blue),node.Transparency ]}
			
		
		elif materialId not in self._currentFamilyElement["materials"] and category in self._categoryList:
			self._currentFamilyElement["materials"].append(materialId)
			self.familyData[category][name][materialId] = {}
			self.familyData[category][name][materialId]["materialInfo"] = {}
			material = self.doc.GetElement(node.MaterialId)
			if material:
				try:
					value = self.GetMaterialInfo(material)
				except Exception as e:
					print e
					value = None
				self.familyData[category][name][materialId]["materialInfo"]["value"] = value
			else:
				# if material is not there, get consistent color
				c = node.Color
				self.familyData[category][name][materialId]["materialInfo"]["value"] = {"diffuseColor":[int(c.Red), int(c.Green), int(c.Blue),node.Transparency ]}
			
		
	def OnPolymesh(self, node):
		name = self._currentFamilyElement["name"]
		category = self._currentFamilyElement["category"]
		materialId = self._currentMaterialId
		# add geometry data according to the material division
		if self._isRevitLink:
			name = self._currentLinkElement["name"]
			category = self._currentLinkElement["category"]
			linkCategory = self._currentLink["category"]
			linkName = self._currentLink["name"]
			if "vertices" not in self.data[linkCategory][linkName][category][name][materialId].keys():
				self.initizializeGeometryData(self.data[linkCategory][linkName][category][name][materialId])
			
			totalFacet = len(self.data[linkCategory][linkName][category][name][materialId]["vertices"])
			self.getGeometryData(self.data[linkCategory][linkName][category][name][materialId], node, totalFacet, category)
			
			
		elif (category in ["Stairs", "Curtain Panels", "Curtain Wall Mullions","Railings", "Top Rails", "Ramps", "Structural Framing", "Columns", "Walls"] or category in self._MEPList or (category == "Mass")):
			if "vertices" not in self.data[category][name][materialId].keys():
				self.initizializeGeometryData(self.data[category][name][materialId])
			
			totalFacet = len(self.data[category][name][materialId]["vertices"])
			self.getGeometryData(self.data[category][name][materialId], node, totalFacet, category)
			
		
		elif category in self._categoryList:
			if "vertices" not in self.familyData[category][name][materialId].keys():
				self.initizializeGeometryData(self.familyData[category][name][materialId])
			
			totalFacet = len(self.familyData[category][name][materialId]["vertices"])
			self.getGeometryData(self.familyData[category][name][materialId], node, totalFacet, category)
		elif category in ["Floors"]:
			if "vertices" not in self.familyData[category][name].keys():
				self.initizializeGeometryData(self.familyData[category][name])
			totalFacet = len(self.familyData[category][name]["vertices"])
			self.getGeometryData(self.familyData[category][name], node, totalFacet, category)
			
			
		
		
	def CurrentTransform(self):
		return self.transformationStack.Peek()
		
	def initizializeGeometryData(self, object):
		object["vertices"] = []
		object["faces"] = []
		object["uvs"] = []
		
	def getGeometryData(self, object, node, totalFacet, category):
		currentTransform = self.CurrentTransform()
		for point in node.GetPoints():
			#print point 
			if (category == "Doors" or category == "Windows") and not self._isRevitLink :
				object["vertices"].append([point[i] for i in range(3)])
			else:
				tp = currentTransform.OfPoint(point)
				object["vertices"].append([tp[i] for i in range(3)])
				
		for uv in node.GetUVs():
			object["uvs"].append([uv[i]for i in range(2)])
			
		for facet in node.GetFacets():
			object["faces"].append([facet.V1+totalFacet, facet.V2+totalFacet,facet.V3+totalFacet])
		
		
	def getNameForFamilyInstance(self, type, family,width, height, isFaceFlipped):
		name = type
		if family:
			name += " " + family
		if width:
			name += "-" + str(int(width))
		if height:
			name += "x" + str(int(height))
		if isFaceFlipped != None:
			name += "-1" if isFaceFlipped else "-0"
			
		return name
		
		
	def getFamilyAndType(self, element):
		try:
			familyName = element.Symbol.FamilyName.ToString()
		except:
			familyName = None
		typeOfElement = element.Name.ToString()
		
		return familyName, typeOfElement
		
		
	def getRequiredPropertiesFromElement(self, element, category):
		location = element.Location
		basePoint = [0,0,0]
		
		
		try:
			transform = element.GetTransform()
			vec_x = transform.BasisX
			# Reference: https://stackoverflow.com/questions/1996957/conversion-euler-to-matrix-and-matrix-to-euler
			euler_x = (2*pi) - math.asin(transform.BasisY.Z)
			rotationX = euler_x
			if (math.cos(euler_x) > 0.0001): 
				rotation = (2*pi) - math.atan2(transform.BasisY.X,transform.BasisY.Y)
			else:
				rotation = (2*pi) - math.atan2(-transform.BasisX.Y,transform.BasisX.X)
				
			
			if(isinstance(location, LocationPoint)):
				basePoint = [location.Point[idx] for idx in range(3)]
				
			if category == "Doors":
				basePoint = [element.GetTotalTransform().Origin[idx] for idx in range(3)]
				if(isinstance(location, LocationPoint)):
					rotation = location.Rotation
					#print rotation
			
		except Exception as e:
			#print e
			try: 
				if(isinstance(location, LocationPoint)):
					basePoint = [location.Point[idx] for idx in range(3)]
					rotation = location.Rotation
				else:
					rotation = 0
			except Exception as e:
				#print e
				rotation = 0
		"""
		
		try: 
			if(isinstance(location, LocationPoint)):
				basePoint = [location.Point[idx] for idx in range(3)]
				rotation = location.Rotation
		except:
			try:
				if(isinstance(location, LocationPoint)):
					basePoint = [location.Point[idx] for idx in range(3)]
				transform = element.GetTransform()
				vec_x = transform.BasisX
				# Reference: https://stackoverflow.com/questions/1996957/conversion-euler-to-matrix-and-matrix-to-euler
				euler_x = (2*pi) - math.asin(transform.BasisY.Z)
				rotationX = euler_x
				if (math.cos(euler_x) > 0.0001): 
					rotation = (2*pi) - math.atan2(transform.BasisY.X,transform.BasisY.Y)
				else:
					rotation = (2*pi) - math.atan2(-transform.BasisX.Y,transform.BasisX.X)
			except:
				basePoint = [0,0,0]
				rotation = 0
				
		"""	
			
		

		try:
			isFaceFlipped = element.FacingFlipped
		except Exception as e:
			isFaceFlipped = False
			#print e
		try:
			isHandFlipped = element.HandFlipped
		except Exception as e:
			isHandFlipped = False
		height = element.get_Parameter(BuiltInParameter.DOOR_HEIGHT)
		width = element.get_Parameter(BuiltInParameter.FURNITURE_WIDTH)
		if width:
			if width.AsDouble() != 0:
				width =width.AsDouble() * 304.8
			elif element.Symbol.LookupParameter("Width").AsDouble() != 0:
				width = element.Symbol.LookupParameter("Width").AsDouble()
				width = width * 304.8
			else:
				width = None
		if height:
			if height.AsDouble() != 0:
				height = height.AsDouble() * 304.8
			elif element.Symbol.LookupParameter("Height").AsDouble() != 0:
				height = element.Symbol.LookupParameter("Height").AsDouble()
				height =height * 304.8
				
			else:
				height = None
				
		offset = 0
		offsetProperty = element.LookupParameter("Offset")
		if element.LookupParameter("Offset"):
			offset = element.LookupParameter("Offset").AsDouble()
		elif element.LookupParameter("Offset from Host"):
			offset = element.LookupParameter("Offset from Host").AsDouble()
		length = None
		if element.Category.Name == "Generic Models":
			if element.LookupParameter("WW-Length"):
				length = element.LookupParameter("WW-Length").AsDouble() * 304.8
		return basePoint, rotation, isFaceFlipped, isHandFlipped, width, height, offset, length
				
		
	def getCenterFromBoundingBox(self, element, category):
		subComponents = []
		# Check if model group contains any walls and floors
		if category in ["Model Groups"]:
			def ExpandToContain(bb, p):
				bb.Min = XYZ( min( bb.Min.X, p.X ), min( bb.Min.Y, p.Y ), min( bb.Min.Z, p.Z ) );
				bb.Max = XYZ( max( bb.Min.X, p.X ), max( bb.Max.Y, p.Y ), max( bb.Max.Z, p.Z ) );
				return bb
			def checkIfElementIsVisible(element):
				idRule = ParameterFilterRuleFactory.CreateEqualsRule(ElementId(BuiltInParameter.ID_PARAM), element.Id)
				idFilter =  ElementParameterFilter(idRule)
				cat = element.Category
				catFilter =  ElementCategoryFilter(cat.Id)
				collector = FilteredElementCollector(self.doc, view.Id).WhereElementIsNotElementType().WherePasses(catFilter).WherePasses(idFilter)
				#debug.append(collector.FirstElement())
				return collector.FirstElement()
				
			bb = BoundingBoxXYZ()
			isfirstElement = True
			isContainsWallsOrFloors = False
			subComponents = element.GetMemberIds()
			for subComponent in subComponents:
				cat = self.doc.GetElement(subComponent).Category
				if cat:
					cat = cat.Name.ToString()
					
				if cat in ["Walls", "Floors"]:
					isContainsWallsOrFloors = True
					break
			
			if isContainsWallsOrFloors:
				for subComponent in subComponents :		
					currentElement = self.doc.GetElement(subComponent)
					cat = currentElement.Category
					if cat:
						cat = cat.Name.ToString()
						
					if cat in self._categoryList and checkIfElementIsVisible(currentElement):
						currentbb = currentElement.get_BoundingBox(view)
						if isfirstElement:
							bb = currentbb
							isfirstElement = False
						else:
							bb = ExpandToContain(bb, currentbb.Max )
							bb = ExpandToContain(bb, currentbb.Min)
						
				rightUpperCorner = [bb.Max[idx]*304.8 for idx in range(3)]
				leftBottomCorner = [bb.Min[idx]*304.8 for idx in range(3)]
				center = []
				for idx in range(3):
					center.append((rightUpperCorner[idx]+leftBottomCorner[idx])/2)
				return center	
		
		"""
		if category in [ "Specialty Equipment", "Furniture Systems"]:
			try:
				#print [element.GetTransform().Origin[idx]*304.8 for idx in range(3)]
				#location = element.Location
				#print [location.Point[idx]*304.8 for idx in range(3)]
				return [element.GetTransform().Origin[idx]*304.8 for idx in range(3)]
			except Exception as e:
				print e
				pass
		"""
		
		if category not in [ "Model Groups", "Casework", "Windows"]:
			try:
				#print [element.GetTransform().Origin[idx]*304.8 for idx in range(3)]
				#location = element.Location
				#print [location.Point[idx]*304.8 for idx in range(3)]
				return [element.GetTotalTransform().Origin[idx]*304.8 for idx in range(3)]
			except Exception as e:
				#print e
				pass

		
		if category in ["Air Terminals", "Mechanical Equipment"]:
			location = element.Location
			if(isinstance(location, LocationPoint)):	
				basePoint = [location.Point[idx]*304.8 for idx in range(3)]
				return basePoint
		
		#print category
		if category == "Doors":
			try:
				location = element.Location
				if(isinstance(location, LocationPoint)):	
					basePoint = [location.Point[idx]*304.8 for idx in range(3)]
					return basePoint
			except:
				return [element.GetTransform().Origin[idx]*304.8 for idx in range(3)]
		try:
			subComponents = element.GetSubComponentIds()
		except:
			subComponents = []
			
		if len(subComponents) > 1:
			basepoint = element.Location
			if isinstance(basepoint, LocationPoint):
				basepoint = [basepoint.Point[idx]*304.8 for idx in range(3)]
				#print basepoint
				return basepoint
				
		bbox = element.get_BoundingBox(view)
		if bbox :
			#debug.append(bbox.Max)
			#debug.append(bbox.Min)
			rightUpperCorner = [bbox.Max[idx]*304.8 for idx in range(3)]
			leftBottomCorner = [bbox.Min[idx]*304.8 for idx in range(3)]
			#print "MAX", rightUpperCorner
			#print "MIN", leftBottomCorner
			center = []
			for idx in range(3):
				center.append((rightUpperCorner[idx]+leftBottomCorner[idx])/2)
			#print "boundingBox:", center
			#print center, category
			return center
		else:
			#print "No Bounding box"
			return [0,0,0]
			
	def convertUnitsTomm(self, value, unit):
		if UnitTypeId.Inches == unit:
			return value*25.4
		elif UnitTypeId.Centimeters == unit:
			return value*10
		elif UnitTypeId.Feet == unit:
			return value*304.8
		elif UnitTypeId.Millimeters == unit:
			return value
		print unit
		return value

	def GetMaterialInfo(self, mat):
		value = {}
		def GetTextureInformation(texture_path, asset):
			"""
			Get texture information from unifiedBitMap
			"""
			#print asset
			value["path"] = os.path.basename(texture_path)
			
			
			if asset.FindByName("texture_RealWorldScaleX") and asset.FindByName("texture_RealWorldScaleY"):
				unitX = asset.FindByName("texture_RealWorldScaleX").GetUnitTypeId()
				unitY = asset.FindByName("texture_RealWorldScaleY").GetUnitTypeId()
				uScale = asset.FindByName("texture_RealWorldScaleX").Value
				vScale = asset.FindByName("texture_RealWorldScaleY").Value
				#print uScale, uScale, unitX.TypeId
				value["uScale"] = self.convertUnitsTomm(uScale, unitX)
				value["vScale"] = self.convertUnitsTomm(vScale, unitY)
				
			else:
				if asset.FindByName("texture_UScale"):
					value["uScale"] = asset.FindByName("texture_UScale").Value
				if asset.FindByName("texture_VScale"):
					value["vScale"] = asset.FindByName("texture_VScale").Value
			if asset.FindByName("texture_UOffset"):
				value["uOffset"] = asset.FindByName("texture_UOffset").Value
			if  asset.FindByName("texture_VOffset"):
				value["vOffset"] = asset.FindByName("texture_VOffset").Value
			if asset.FindByName("texture_WAngle"):
				value["wAng"] = asset.FindByName("texture_WAngle").Value
		
		def getparameterFromAsset(asset):
			"""
			Used for nested Asset
			"""
			for i in range(asset.Size):
				#print getRenderingAsset.Get(i).Name
				name = asset.Get(i).Name
				if name == "unifiedbitmap_Bitmap":
					texture_path = asset.FindByName("unifiedbitmap_Bitmap").Value
					if texture_path:
						GetTextureInformation(texture_path, asset)
						return value
	
		appearanceAssetId = mat.AppearanceAssetId
	
		assetElem = self.doc.GetElement(appearanceAssetId)
		if not assetElem: # return consistent color
			value['diffuseColor'] = [float(mat.Color.Red)/255, float(mat.Color.Green)/255, float(mat.Color.Blue)/255, 1 - float(mat.Transparency)/100]
			value['name'] = mat.Id.ToString()
			return value
		#print assetElem.Name
	
		getRenderingAsset = assetElem.GetRenderingAsset()
		value["name"] = assetElem.Name
		property = getRenderingAsset.FindByName("localname")
		className = mat.MaterialClass
		if property or ((not property) and className):
			if property:
				property = property.Value.ToString()
				value["type"] = property
			else:
				value["type"] = className
			# If material class is Glazing
			if property == "Glazing" or ((not property) and className == "Glass"):
				#print property, "----"
				GLAZINGCOLOR = ["Clear", "Green", "Gray","Blue", "Bluegreen", "Bronze", "Custom"]
					
				colorMap = getRenderingAsset.FindByName("glazing_transmittance_color").Value
				
				glassColor = GLAZINGCOLOR[colorMap]
				
				if glassColor == "Clear":
					value["diffuseColor"] = [0,0,0,0.2]
				elif glassColor == "Green":
					value["diffuseColor"] = [0,1,0,0.2]
				elif glassColor == "Gray":
					value["diffuseColor"] = [0.32, 0.32, 0.32,0.2]
				elif glassColor == "Blue":
					value["diffuseColor"] = [0, 0, 1,0.2]
				elif glassColor == "Bluegreen":
					value["diffuseColor"] = [0.05,0.59,0.73,0.2]
				elif glassColor == "Bronze":
					value["diffuseColor"] = [0.8, 0.5,0.2,0.2]
				else:
					colorMap = getRenderingAsset.FindByName("glazing_transmittance_map").GetValueAsDoubles()
					value["diffuseColor"] = [ i for i in colorMap]
					value["diffuseColor"].append(0.2)
					#print value["diffuseColor"]
				#print value
				return value
			
					
		
		for i in range(getRenderingAsset.Size):

			name = getRenderingAsset.Get(i).Name
			if name == "unifiedbitmap_Bitmap":
				texture_path = asset.FindByName("unifiedbitmap_Bitmap").Value
				if texture_path:
					GetTextureInformation(texture_path, getRenderingAsset)
					#print value		
			property = getRenderingAsset.FindByName(name)
			# diffuse => generic, glazing => glazing class
			isValidProperty = re.search("(?=(diffuse))",property.Name.ToString() ) or re.search(r'(?=(color))',property.Name.ToString()) or re.search(r"(?=(glazing))", property.Name.ToString())
			
			# if property has connected properties check if texture is present
			if property.NumberOfConnectedProperties > 0 and property.Name.ToString() not in ["common_Tint_color"] and isValidProperty:
			 	
			 	if isinstance(property, AssetPropertyDoubleArray4d):
			 		value["diffuseColor"] = [ i for i in property.GetValueAsDoubles()]
			 		alpha = getRenderingAsset.FindByName("generic_transparency")
			 		if alpha and alpha.Value != 0:
			 			value["diffuseColor"][3] = float(1 - alpha.Value)
			 	#print property, property.GetAllConnectedProperties()
				getparameterFromAsset(property.GetAllConnectedProperties()[0])
				
			# else get color property.
			elif isinstance(property, AssetPropertyDoubleArray4d) and property.Name.ToString() not in ["common_Tint_color"] and isValidProperty :
				#print property.Name.ToString(), property.GetValueAsDoubles()
				value["diffuseColor"] = [ i for i in property.GetValueAsDoubles()]
				alpha = getRenderingAsset.FindByName("generic_transparency")
			 	if alpha and alpha.Value != 0:
			 		value["diffuseColor"][3] = float(1 - alpha.Value)
				

		return value
		
	def handleColumns(self, element):
		noOfFaces = 0
		def handleSolid(solid, noOfFaces):
			columnBottomFace = []
			for f in solid.Faces:
				if (f.ComputeNormal(UV(0.5,0.5)).Z < 0):
					noOfFaces += 1
					#if True: to get bottom face
					edges = f.GetEdgesAsCurveLoops()
					for e in edges:
						for cl in e.GetCurveLoopIterator():
							columnBottomFace.append([cl.GetEndPoint(0)[idx]* 304.8 for idx in range(3)])
							#print columnBottomFace
					break
			#print columnBottomFace, "*"
			return columnBottomFace
		opt = Options()
		opt.View = self.doc.ActiveView
		columnBottomVertices = []
		for geo in element.get_Geometry(opt):
			if isinstance(geo, Solid):
				bottomFace = handleSolid(geo, noOfFaces)
				columnBottomVertices += bottomFace
			if isinstance(geo, GeometryInstance):
				for g in geo.GetInstanceGeometry():
					if isinstance(g, Solid):
						bottomFace = handleSolid(g, noOfFaces)
						columnBottomVertices += bottomFace	
		height = 0
		if element.get_Parameter(BuiltInParameter.INSTANCE_LENGTH_PARAM):
			height = element.get_Parameter(BuiltInParameter.INSTANCE_LENGTH_PARAM).AsDouble()*304.8
		elif element.LookupParameter("Height"):
			height = element.LookupParameter("Height").AsDouble()*304.8
			
		mats = element.GetMaterialIds(False)
		value = None
		if len(mats) > 0:
			matId = mats[0]
			mat = self.doc.GetElement(matId)
			value = self.GetMaterialInfo(mat)
			
				
		return columnBottomVertices, height, value, noOfFaces

				
				
		
		
context = myContextExport(doc)

exporter = CustomExporter(doc, context)
#exporter.IncludeFaces = False;

# export the active view
exporter.Export(view)

familyData = context.familyData
data = context.data
componentsData = context.creationData

outList = []
mainList = []
keys = []


for k,v in data.items():
	keys.append(k)
	outList.append(json.dumps(v, False, False))
mainList.append(outList)

outList = []
for k,v in familyData.items():

	outList.append(json.dumps(v,False, False))
mainList.append(outList)
outList = []

for k,v in componentsData.items():
	outList.append(json.dumps(v,False, False))
	
mainList.append(outList)
outList = []
#print(keys)
	
# Assign your output to the OUT variable.
OUT = keys, mainList
# ----------------------------------------
python_script_2 = Python(IN[0]=wall_types, IN[1]=floor_types, IN[2]=ceiling_types, IN[3]=column_types, IN[4]=door_types, IN[5]=window_types, IN[6]=python_script, IN[7]=revit_export)  # IronPython2
# ---------- python_script_2.python (71 lines) ----------
# Load the Python Standard and DesignScript Libraries
import sys
import clr
clr.AddReference('ProtoGeometry')
from Autodesk.DesignScript.Geometry import *
from System.Collections.Generic import Dictionary

# The inputs to this node will be stored as a list in the IN variables.
walltypeData = IN[0][0]
wallSideProfile = IN[0][1]
wallInsertsData = IN[0][2]
floortypeData = IN[1]
ceilingtypeData = IN[2][0]
ceilingData = IN[2][1]
columntypeData = IN[3]
doortypeData = IN[4][0]
doorsWallMap = IN[4][1]
windowtypeData = IN[5][0]
windowsWallMap = IN[5][1]
componentsData = IN[6]



revitExportKeys = IN[7][0]
revitExportData = IN[7][1][0]
revitExportFamilyData = IN[7][1][1]
revitExportComponentsData = IN[7][1][2]


# Place your code below this line
#data = componentsData

list = [walltypeData,wallSideProfile, wallInsertsData, floortypeData, columntypeData, ceilingtypeData,ceilingData, windowtypeData, windowsWallMap, doortypeData, doorsWallMap]

NAMES = ["wallTypes","wallSideProfile","wallInsertsData", "floorTypes", "columnTypes","ceilingTypes","ceilings","windowTypes","windowsWallMap","doorTypes","doorsWallMap" ]

for idx in range(len(revitExportData)):
	if len(revitExportData[idx]) == 2: # i.e. "{}"
		continue
	NAMES.append(revitExportKeys[idx])
	list.append(revitExportData[idx])

for idx in range(len(revitExportFamilyData)):
	if len(revitExportFamilyData[idx]) == 2: # i.e. "{}"
		continue
	NAMES.append(revitExportKeys[idx]+"*FamilyData")
	list.append(revitExportFamilyData[idx])
	
for idx in range(len(revitExportComponentsData)):
	if len(revitExportComponentsData[idx]) == 2: # i.e. "{}"
		continue
	NAMES.append(revitExportKeys[idx]+"*ComponentsData")
	list.append(revitExportComponentsData[idx])

outlist = componentsData

# divide data to so that it will be less than 10000000
for idx in range(len(list)):
	#d = Dictionary[str, object]({NAMES[idx] : list[idx]})
	#outlist.append(d)
	count = 1
	for elem in range(0,len(list[idx]),8000000):
		start = elem
		end = elem + 8000000 if len(list[idx]) > elem + 8000000 else len(list[idx])
		name = NAMES[idx]+ "-" + str(count)
		d = Dictionary[str, object]({name : list[idx][start:end]})
		count += 1
		outlist.append(d)
		
	
OUT = outlist 
# ----------------------------------------
stream = Python()  # IronPython2; unwired: IN[0]
# ---------- stream.python (49 lines) ----------
# pipe_id = '\\\\.\\pipe\\'
# pipe_name = 'snaptrudeDynamoPipe'

# pipein = open(pipe_id + pipe_name, 'r')
# stream_id = pipein.read(10) # 10 alpha numeric characters

import clr

#Sets up new path to ironpython module Library
#See https://docs.python.org/2/library/sys.html
import sys
sys.path.append("C:\Program Files (x86)\IronPython 2.7\Lib")

import os
import json

app_data_store = os.path.join(os.getenv('APPDATA'), 'snaptrude-manager', 'config.json')
file = None

# print(app_data_store)

try:
    file = open(app_data_store)
except Exception as e:
    print('File not found')
    print(e)
    OUT = ""
    quit()

data = json.load(file)
stream_id = data['streamId']

file.close()

url_store = os.path.join(os.getenv('APPDATA'), 'snaptrude-manager', 'urls.json')
speckle_url = 'https://speckle.snaptrude.com'

try:
    file = open(url_store)
    data = json.load(file)
    speckle_url = data['speckleUrl']
except Exception as e:
    print("No urls file")

speckle_url = speckle_url + '/streams/' + stream_id

print(speckle_url)

OUT = speckle_url
# ----------------------------------------
project_name = Python()  # IronPython2
# ---------- project_name.python (18 lines) ----------
# Load the Python Standard and DesignScript Libraries
import sys
import clr
clr.AddReference('ProtoGeometry')
from Autodesk.DesignScript.Geometry import *

clr.AddReference("RevitServices")
import RevitServices
from RevitServices.Persistence import DocumentManager

# The inputs to this node will be stored as a list in the IN variables.


# Place your code below this line
doc = DocumentManager.Instance.CurrentDBDocument

# Assign your output to the OUT variable.
OUT = doc.Title
# ----------------------------------------
send = Send(data=python_script_2, stream=stream, message=project_name, AutoUpdate=true)
watch = Watch(send)
